# Dynamo graph CodeBlock.dyn (Dynamo 0.9.1.4062)

# note: Code Block nodes that define a function do not have input or output ports because they are called from other Code Block nodes.

# note: Together, these statements form an algorithm that creates a helical curve at a base point.
code_block = CodeBlock()
# ---------- code_block.designscript (16 lines) ----------
// Basic inputs
base = Point.ByCoordinates(3,3);
coils = 3;
height = 5;
rad = 0.5;

// Make a series of points
numPts = 8*coils + 1;
seq = 0..(coils*360)..#numPts;
x = rad * Math.Cos(seq);
y = rad * Math.Sin(seq);
z = 0..height..#numPts;
pts = Point.ByCoordinates(x + base.X, y + base.Y, z + base.Z);

// Pass a curve through those points
NurbsCurve.ByPoints(pts);
# ----------------------------------------
# note: The helix algorithm is transformed into a function by giving it a name, specifying the inputs, and telling it what to return.
code_block_2 = CodeBlock()
# ---------- code_block_2.designscript (13 lines) ----------
def MakeSpring(base,coils,height,rad)
{
// Make a series of points
numPts = 8*coils + 1;
seq = 0..(coils*360)..#numPts;
x = rad * Math.Cos(seq);
y = rad * Math.Sin(seq);
z = 0..height..#numPts;
pts = Point.ByCoordinates(x + base.X, y + base.Y, z + base.Z);

// Return the curve that passes through those points
return = NurbsCurve.ByPoints(pts);
};
# ----------------------------------------
# note: The helix algorithm is transformed to define a function with the arbitrary name "MakeSpring".  This function is called to make several springs, with random heights, arranged in a grid.
code_block_3 = CodeBlock { 0..6..2; }
code_block_4 = CodeBlock { 10..20..2; }
# note: makes a grid
byCoordinates = Point.ByCoordinates(x=code_block_3, y=code_block_4, lacing=CrossProduct)
flatten = Flatten(byCoordinates)
code_block_5 = CodeBlock { 5; }
count = Count(flatten)
# note: makes a series of random numbers (scaled by 5) for the spring heights
randomList = Math.RandomList(count)
code_block_6 = CodeBlock(random=randomList) { random * 5; }
# note: Inputs to function calls can be made with lists of things or single-value items. Data can be passed in through a port or declared directly, as in the case of "0.5" for the radii of all springs.
code_block_7 = CodeBlock(basePoints=flatten, numCoils=code_block_5, height=code_block_6) { MakeSpring(basePoints,numCoils,height,0.5); }
# note: Functions can be defined directly in a Code Block node to be called elsewhere in this definition.
# The first line has the key word "def", then the function name, then the inputs in parentheses.
# Curly braces define the body of the function.  Each line must end in a semicolon.
# Return a value with "return = ".
code_block_8 = CodeBlock()
# ---------- code_block_8.designscript (11 lines) ----------
/* This is a multi-line comment,
     which continues for mulitple
     lines. */

def FunctionName(input1, input2)
{
// This is a comment
sum = input1 + input2;

return = sum;
};
# ----------------------------------------
# note: Call the function with another Code Block node in the same file by giving the same name and the same number of arguments.
code_block_9 = CodeBlock { 1; }
code_block_10 = CodeBlock { 2; }
code_block_11 = CodeBlock(in1=code_block_9, in2=code_block_10) { FunctionName(in1,in2); }
watch = Watch(code_block_11)
# note: The type of the input arguments is not specified in the function definition, so it will operate on whatever it receives.
code_block_12 = CodeBlock { "cat"; }
code_block_13 = CodeBlock { "dog"; }
code_block_14 = CodeBlock(in1=code_block_12, in2=code_block_13) { FunctionName(in1,in2); }
watch_2 = Watch(code_block_14)
# note: A function call with inputs that do not make sense for that function will give a null result.
origin = Point.Origin()
code_block_15 = CodeBlock { 16; }
code_block_16 = CodeBlock(in1=origin, in2=code_block_15) { FunctionName(in1,in2); }
watch_3 = Watch(code_block_16)
# note: Code Block nodes can be made by double-clicking in the canvas.  They are also in the library with other nodes.
# Code Blocks can hold numbers, strings, and formulas.  See the math sample file to learn the differences between math with the Formula node and the Code Block node.
number = DoubleInput(3.14)
watch_4 = Watch(number)
string = StringInput("Less is more.")
watch_5 = Watch(string)
formula = Formula("3*5")
watch_6 = Watch(formula)
code_block_17 = CodeBlock { "Less is more."; }
# note: Use quotes "" to make a string.
watch_7 = Watch(code_block_17)
code_block_18 = CodeBlock { 3.142; }
watch_8 = Watch(code_block_18)
code_block_19 = CodeBlock { 3*5; }
watch_9 = Watch(code_block_19)
# note: With Code Blocks, a user has flexibility to decide how to specify inputs.  Here are several different ways, for example, to make the same point.
code_block_20 = CodeBlock { 10; }
code_block_21 = CodeBlock { -10; }
byCoordinates_2 = Point.ByCoordinates(x=code_block_20, y=code_block_21)
watch_10 = Watch(byCoordinates_2)
code_block_22 = CodeBlock(x=code_block_20, y=code_block_21) { z = 0; Point.ByCoordinates(x,y,z); }
watch_11 = Watch(code_block_22.out1)
# note: Create-type methods that have no inputs still require parentheses.
origin_2 = Point.Origin()
watch_12 = Watch(origin_2)
code_block_23 = CodeBlock { Point.Origin(); }
watch_13 = Watch(code_block_23)
# note: Query.
# Query-type methods get a property of an object, so they need no inputs.
code_block_24 = CodeBlock { Point.ByCoordinates(10,0,0); }
code_block_25 = CodeBlock(pt=code_block_24) { pt.X; }
watch_14 = Watch(code_block_25)
X = Point.X(code_block_24)
watch_15 = Watch(X)
code_block_26 = CodeBlock(num=code_block_20) { Point.ByCoordinates(num,-num,0); }
watch_16 = Watch(code_block_26)
code_block_27 = CodeBlock { Point.ByCoordinates(10,-10,0); }
watch_17 = Watch(code_block_27)
# note: Code Blocks can be used to call any other node in the library.  Nodes in the library generally come in three types:
#     Create: create something
#     Action: perform an action on something
#     Query:  get a property of something
#   that already exists
# Methods, or nodes, of these three types are treated differently when invoked within a Code Block.
# note: Create.
# When you use a method to create something, call it by name and specify the inputs in the order found in the out-of-the-box node.
code_block_28 = CodeBlock { 0; -10; }
byCoordinates_3 = Point.ByCoordinates(x=code_block_28.out0, y=code_block_28.out1)
watch_18 = Watch(byCoordinates_3)
code_block_29 = CodeBlock { Point.ByCoordinates(0,-10); }
watch_19 = Watch(code_block_29)
# note: Action.
# An action is perfomed ON an object of that type.  Use dot notation after the object itself and specify all of the inputs found on the out-of-the-box node except for the first one (since the first input port is the object itself, which you already have!)
origin_3 = Point.Origin()
ZAxis = Vector.ZAxis()
add = Point.Add(point=origin_3, vectorToAdd=ZAxis)
watch_20 = Watch(add)
origin_4 = Point.Origin()
ZAxis_2 = Vector.ZAxis()
code_block_30 = CodeBlock(pt=origin_4, vec=ZAxis_2) { pt.Add(vec); }
watch_21 = Watch(code_block_30)
# note: Make lists with braces.
code_block_31 = CodeBlock { {"San Francisco","New York","Chicago"}; }
watch_22 = Watch(code_block_31)
# note: Get items from a list with brackets.
code_block_32 = CodeBlock(cities=watch_22) { cities[2]; }
watch_23 = Watch(code_block_32)
code_block_33 = CodeBlock()
# ---------- code_block_33.designscript (7 lines) ----------
str0 = "alpha";
str1 = "beta";
str2 = "charlie";
str3 = "delta";
str4 = "echo";
//
{str0,str1,str2,str3,str4};
# ----------------------------------------
watch_24 = Watch(code_block_33.out5)
code_block_34 = CodeBlock(phonetic=watch_24) { phonetic[2..3]; }
watch_25 = Watch(code_block_34)
# note: Create nested lists and get items from nested lists.
code_block_35 = CodeBlock()
# ---------- code_block_35.designscript (6 lines) ----------
kitchen = {"table","stove","sink","refrigerator"};
livingRoom = {"sofa","books"};
bedroom = {"bed","dirty clothes"};
bathroom = {"tooth brush"};
//
allMyStuff = {kitchen, livingRoom, bedroom, bathroom};
# ----------------------------------------
watch_26 = Watch(code_block_35.allMyStuff)
code_block_36 = CodeBlock(list=watch_26) { list[2][1]; }
watch_27 = Watch(code_block_36)
# note: Replication guides can be used to specify that lists be laced as a "cross product."
code_block_37 = CodeBlock { x_vals = 0..10; y_vals = -30..-40; }
code_block_38 = CodeBlock(x_vals=code_block_37.x_vals, y_vals=code_block_37.y_vals) { Point.ByCoordinates(x_vals, y_vals); }
code_block_39 = CodeBlock { x_vals = 0..10; y_vals = -15..-25; }
code_block_40 = CodeBlock(x_vals=code_block_39.x_vals, y_vals=code_block_39.y_vals) { Point.ByCoordinates(x_vals<1>, y_vals<2>); }
byCoordinates_4 = Point.ByCoordinates(x=code_block_37.x_vals, y=code_block_37.y_vals)
byCoordinates_5 = Point.ByCoordinates(x=code_block_39.x_vals, y=code_block_39.y_vals, lacing=CrossProduct)
# note: Replication guides, which use angle brackets, take two or three one-dimensional collections, and pair
# the elements together to generate a one, two- or three-dimensional collection.
code_block_41 = CodeBlock()
# ---------- code_block_41.designscript (5 lines) ----------
x_vals = 0..1;
y_vals = -3..-7;
//
Point.ByCoordinates(x_vals<1>, y_vals<2>);
Point.ByCoordinates(x_vals<2>, y_vals<1>);
# ----------------------------------------
watch_28 = Watch(code_block_41.out2)
# note: In this example, there are 2 x-values and 5 y-values.  Replications guides can specify that the resultant combination is 2 lists of 5 points or 5 lists of 2 points.
watch_29 = Watch(code_block_41.out3)
code_block_42 = CodeBlock()
# ---------- code_block_42.designscript (10 lines) ----------
def addst(x)
{
return=[Imperative]{
 for (i in x)
 {
  a=i+"风管";
 }
 return=a;
}
};
# ----------------------------------------
