# Dynamo custom node Create Floor of Rooms111.dyf "111" (Dynamo 0.8.0.950)
# 111

categories = Categories("Rooms")
all_elements_of_category = ElementsOfCategory(categories)
string = StringInput("名称")
getParameterValueByName = Element.GetParameterValueByName(element=all_elements_of_category, parameterName=string)
list = Input()
code_block = CodeBlock(list=list) { list[0]; list[1]; }
eq = getParameterValueByName == code_block.out1
filterByBoolMask = List.FilterByBoolMask(list=all_elements_of_category, mask=eq)
python_script = Python(IN[0]=filterByBoolMask.in)
# ---------- python_script.python (55 lines) ----------
import clr

# Import RevitAPI
clr.AddReference("RevitAPI")
import Autodesk
from Autodesk.Revit.DB import *

# Import DocumentManager and TransactionManager
clr.AddReference("RevitServices")
import RevitServices
from RevitServices.Persistence import DocumentManager
from RevitServices.Transactions import TransactionManager

# Import ToDSType(bool) extension method
clr.AddReference("RevitNodes")
import Revit
clr.ImportExtensions(Revit.Elements)
clr.ImportExtensions(Revit.GeometryConversion)

import clr
clr.AddReference('ProtoGeometry')
from Autodesk.DesignScript.Geometry import *

rooms = UnwrapElement(IN[0])

output = []
areas = []
boundaries = []
locations = []
levels=[]

for faminst in rooms:
	area = faminst.Area
	location = faminst.Location.Point.ToPoint()
	boptions = Autodesk.Revit.DB.SpatialElementBoundaryOptions()
	boundsegs = faminst.GetBoundarySegments(boptions)
	boundcurves = []
	for bound in boundsegs:
		crvs = []
		for seg in bound:
			crv = seg.Curve
			crvs.append(Revit.GeometryConversion.RevitToProtoCurve.ToProtoType(crv,True))
		boundcurves.append(crvs)
	levels.append(faminst.Level)	
	areas.append(area)
	boundaries.append(boundcurves)
	locations.append(location)


output.append(areas)
output.append(locations)
output.append(boundaries)	
output.append(levels)
#Assign your output to the OUT variable
OUT = output
# ----------------------------------------
number = DoubleInput(2)
getItemAtIndex = List.GetItemAtIndex(list=python_script, index=number)
number_2 = DoubleInput(1)
flatten = List.Flatten(list=getItemAtIndex, amt=number_2)
byName = FloorType.ByName(code_block.out0)
number_3 = DoubleInput(3)
getItemAtIndex_2 = List.GetItemAtIndex(list=python_script, index=number_3)
byOutlineTypeAndLevel = Floor.ByOutlineTypeAndLevel(outlineCurves=flatten, floorType=byName, level=getItemAtIndex_2)
string_2 = StringInput("自标高的高度偏移")
string_3 = StringInput("厚度")
getParameterValueByName_2 = Element.GetParameterValueByName(element=byOutlineTypeAndLevel, parameterName=string_3)
setParameterByName = Element.SetParameterByName(element=byOutlineTypeAndLevel, parameterName=string_2, value=getParameterValueByName_2)
