# Dynamo custom node Get Curtaingrid.dyf (Dynamo 0.8.1.1823)
# category: DynamoChina
# get gridline from curtain

Curtain = Input()
python_script = Python(IN[0]=Curtain)
# ---------- python_script.python (65 lines) ----------
#Copyright (c) 2015, zhangzbxyz
#Dynamo中文社区 http://dynamochina.com

import clr

clr.AddReference("RevitAPI")
import Autodesk
from Autodesk.Revit.DB import *

clr.AddReference("RevitServices")
import RevitServices
from RevitServices.Persistence import DocumentManager

clr.AddReference("RevitNodes")
import Revit

clr.ImportExtensions(Revit.Elements)
clr.ImportExtensions(Revit.GeometryConversion)

doc = DocumentManager.Instance.CurrentDBDocument
input=UnwrapElement(IN[0])

uls=[]
vls=[]
ulset=[]
vlset=[]
str="please select a curtainwall or curtainsytem!"

if isinstance(input,CurtainSystem):
	cgset=input.CurtainGrids
	for i in cgset:
		ulids=i.GetUGridLineIds()
		vlids=i.GetVGridLineIds()
		for ulid in ulids:
			ul=doc.GetElement(ulid)
			uline=ul.FullCurve.ToProtoType()
			uls.append(uline)
		for vlid in vlids:
			vl=doc.GetElement(vlid)
			vline=vl.FullCurve.ToProtoType()
			vls.append(vline)        
		ulset.append(uls)
		vlset.append(vls)
	out=[ulset,vlset]
elif isinstance(input,Wall):
	walltype=doc.GetElement(input.GetTypeId())
	if walltype.Kind==WallKind.Curtain:
		cgset=input.CurtainGrid
		ulids=cgset.GetUGridLineIds()
		vlids=cgset.GetVGridLineIds()
		for ulid in ulids:
			ul=doc.GetElement(ulid)
			uline=ul.FullCurve.ToProtoType()
			uls.append(uline)
		for vlid in vlids:
			vl=doc.GetElement(vlid)
			vline=vl.FullCurve.ToProtoType()
			vls.append(vline)        
		out=[uls,vls]
	else:
		out=[str,str]
else:
	out=[str,str]
        
OUT = out
# ----------------------------------------
code_block = CodeBlock(a=python_script) { a[0]; }
code_block_2 = CodeBlock { 1; }
flatten = List.Flatten(list=code_block, amt=code_block_2)
U_Grid_Lines = Output(flatten)
code_block_3 = CodeBlock(a=python_script) { a[1]; }
flatten_2 = List.Flatten(list=code_block_3, amt=code_block_2)
V_Grid_Lines = Output(flatten_2)
