# Dynamo custom node Get Parameters.dyf (Dynamo 0.8.1.1823)
# category: DynamoChina
# Get Parameters from Elements

Elements = Input()
Parameter_Names = Input()
code_block = CodeBlock(x=Parameter_Names) { {x,{}}; }
flatten = Flatten(code_block)
python_script = Python(IN[0]=Elements, IN[1]=flatten)
# ---------- python_script.python (112 lines) ----------
#Copyright (c) 2015, zhangzbxyz
#Dynamo中文社区 http://dynamochina.com

import clr

clr.AddReference("RevitAPI")
import Autodesk
from Autodesk.Revit.DB import *
from Autodesk.Revit.DB.Plumbing import *
from Autodesk.Revit.DB.Mechanical import *

clr.AddReference("RevitServices")
import RevitServices
from RevitServices.Persistence import DocumentManager

clr.AddReference("RevitNodes")
import Revit

clr.ImportExtensions(Revit.Elements)

def getfam(ele):
	try:
		if isinstance(ele,FamilySymbol):
			return ele.Family.Name
		else:
			return ele.Category.Name
	except:
		return
		
def getparaval(para):
	ptype=para.StorageType
	if ptype==StorageType.String:
		paravalue=para.AsString()
	else:
		paravalue=para.AsValueString()	
	return paravalue

instlist = []
paranames=IN[1]

try:
	for item in IN[0]:
		instlist.append(UnwrapElement(item))
except:
	instlist.append(UnwrapElement(IN[0]))
	
doc = DocumentManager.Instance.CurrentDBDocument
output = []
famsyms = []
elementids = []
paraset = []
fams=[]
flag0= 0 if len(paranames)==0 else 1

if flag0:
	for i in range(len(paranames)):
		paraset.append([])

for inst in instlist:
	famsym=doc.GetElement(inst.GetTypeId())
	#famsymname=inst.Name
	fam=getfam(famsym)
	for i in range(len(paranames)):
		try:
			instpara= inst.Parameter[paranames[i]]
			fampara=famsym.Parameter[paranames[i]]
		except:
			continue
		try:
			para=getparaval(instpara)
		except:
			try:
				para=getparaval(fampara)
			except:
				para="no parameter"
		paraset[i].append(para)
	try:
		fams.append(fam)
	except:
		fams.append("error")
	try:
		famsyms.append(inst.Name)
	except:
		famsyms.append("error")
	try:
		elementids.append(inst.Id.ToString())
	except:
		elementids.append("error")

if len(instlist)==1:
	output.append(fams[0])
	output.append(famsyms[0])
	output.append(elementids[0])
	if flag0:
		if len(paranames)==1:
			output.append(paraset[0][0])
		else:
			_paraset=[]
			for i in range(len(paranames)):
				_paraset.append(paraset[i][0])
			output.append(_paraset)
else:
	output.append(fams)
	output.append(famsyms)
	output.append(elementids)
	if flag0:
		if len(paranames)==1:
			output.append(paraset[0])
		else:
			output.append(paraset)
	        
OUT = output
# ----------------------------------------
code_block_2 = CodeBlock(list=python_script) { list[0]; list[1]; list[2]; list[3]; }
Family = Output(code_block_2.out0)
FamilySymbol = Output(code_block_2.out1)
ElementID = Output(code_block_2.out2)
Parameters = Output(code_block_2.out3)
