# Dynamo custom node Get Room Infomation.dyf (Dynamo 0.8.0.950)
# category: DynamoChina
# Get Room Infomation

Rooms = Input()
python_script = Python(IN[0]=Rooms)
# ---------- python_script.python (63 lines) ----------
import clr

# Import RevitAPI
clr.AddReference("RevitAPI")
import Autodesk
from Autodesk.Revit.DB import *

# Import DocumentManager and TransactionManager
clr.AddReference("RevitServices")
import RevitServices
from RevitServices.Persistence import DocumentManager
from RevitServices.Transactions import TransactionManager

# Import ToDSType(bool) extension method
clr.AddReference("RevitNodes")
import Revit
clr.ImportExtensions(Revit.Elements)
clr.ImportExtensions(Revit.GeometryConversion)

import clr
clr.AddReference('ProtoGeometry')
from Autodesk.DesignScript.Geometry import *

_room = UnwrapElement(IN[0])

output = []
boundaries = []
locations = []
rooms=[]
names=[]

try:
	for room in _room:
		rooms.append(room)
except:
	rooms.append(_room)

for faminst in rooms:
	area = faminst.Area	
	location = faminst.Location.Point.ToPoint()
	
	names.append(faminst.get_Parameter(BuiltInParameter.ROOM_NAME).AsString())
	locations.append(location)
	
	if area>0:
		boptions = Autodesk.Revit.DB.SpatialElementBoundaryOptions()
		boundsegs = faminst.GetBoundarySegments(boptions)
		boundcurves = []
		for bound in boundsegs:
			crvs = []
			for seg in bound:
				crv = seg.Curve
				crvs.append(Revit.GeometryConversion.RevitToProtoCurve.ToProtoType(crv,True))
			boundcurves.append(crvs)
		boundaries.append(boundcurves)
	else:
		boundaries.append(None)
		
output.append(names)
output.append(locations)
output.append(boundaries)	

OUT = output
# ----------------------------------------
code_block = CodeBlock(list=python_script) { list[0]; list[1]; list[2]; }
Location = Output(code_block.out1)
Boundaries = Output(code_block.out2)
Name = Output(code_block.out0)
