# Dynamo custom node Get Room Infomation.dyf (Dynamo 0.8.0.950)
# category: DynamoChina
# Get Room Infomation

Rooms = Input()
empty = List.Empty()
create = List.Create(Rooms, empty)
flatten = Flatten(create)
python_script = Python(IN[0]=flatten)
# ---------- python_script.python (55 lines) ----------
import clr

# Import RevitAPI
clr.AddReference("RevitAPI")
import Autodesk
from Autodesk.Revit.DB import *

# Import DocumentManager and TransactionManager
clr.AddReference("RevitServices")
import RevitServices
from RevitServices.Persistence import DocumentManager
from RevitServices.Transactions import TransactionManager

# Import ToDSType(bool) extension method
clr.AddReference("RevitNodes")
import Revit
clr.ImportExtensions(Revit.Elements)
clr.ImportExtensions(Revit.GeometryConversion)

import clr
clr.AddReference('ProtoGeometry')
from Autodesk.DesignScript.Geometry import *

rooms = UnwrapElement(IN[0])

output = []
areas = []
boundaries = []
locations = []
levels=[]

for faminst in rooms:
	area = faminst.Area
	location = faminst.Location.Point.ToPoint()
	boptions = Autodesk.Revit.DB.SpatialElementBoundaryOptions()
	boundsegs = faminst.GetBoundarySegments(boptions)
	boundcurves = []
	for bound in boundsegs:
		crvs = []
		for seg in bound:
			crv = seg.Curve
			crvs.append(Revit.GeometryConversion.RevitToProtoCurve.ToProtoType(crv,True))
		boundcurves.append(crvs)
	levels.append(faminst.Level)	
	areas.append(area)
	boundaries.append(boundcurves)
	locations.append(location)


output.append(areas)
output.append(locations)
output.append(boundaries)	
output.append(levels)
#Assign your output to the OUT variable
OUT = output
# ----------------------------------------
number = DoubleInput(0)
getItemAtIndex = List.GetItemAtIndex(list=python_script, index=number)
Area = Output(getItemAtIndex)
number_2 = DoubleInput(1)
getItemAtIndex_2 = List.GetItemAtIndex(list=python_script, index=number_2)
Location = Output(getItemAtIndex_2)
number_3 = DoubleInput(2)
getItemAtIndex_3 = List.GetItemAtIndex(list=python_script, index=number_3)
Boundaries = Output(getItemAtIndex_3)
number_4 = DoubleInput(3)
getItemAtIndex_4 = List.GetItemAtIndex(list=python_script, index=number_4)
Levels = Output(getItemAtIndex_4)
