# Dynamo graph Home.dyn (Dynamo 0.8.0.950)

select_model_element = DSModelElementSelection()  # 1 picked in the model
code_block = CodeBlock { "类型注释"; }
python_script = Python(IN[0]=select_model_element, IN[1]=code_block)
# ---------- python_script.python (80 lines) ----------
"""
Copyright Peter Kompolschek 2015
finds elements in rooms
"""
import sys
import clr
clr.AddReference('ProtoGeometry')
from Autodesk.DesignScript.Geometry import *
# Import ToDSType(bool) extension method
clr.AddReference("RevitNodes")
import Revit
clr.ImportExtensions(Revit.Elements)
# Import geometry conversion extension methods
clr.ImportExtensions(Revit.GeometryConversion)
# Import DocumentManager and TransactionManager
clr.AddReference("RevitServices")
import RevitServices
from RevitServices.Persistence import DocumentManager
from RevitServices.Transactions import TransactionManager
from System.Collections.Generic import *
# Import RevitAPI
clr.AddReference("RevitAPI")
import Autodesk
from Autodesk.Revit.DB import *
from Autodesk.Revit.DB.Plumbing import *

from Autodesk.Revit.DB.Mechanical import *
#initialise lists and parameters
#librarypaths

doc =  DocumentManager.Instance.CurrentDBDocument
app =  DocumentManager.Instance.CurrentUIApplication.Application

def getsymbol(ele):
	if ele.GetType()==FamilyInstance:
		return ele.Symbol
	elif ele.GetType()==Wall:
		return ele.WallType
	elif ele.GetType()==Floor:
		return ele.FloorType
	elif ele.GetType()==RoofBase:
		return ele.RoofType
	elif ele.GetType()==Pipe:
		return ele.PipeType

def returnsymbol(ele):
	if isinstance(ele,FamilyInstance):
		return "FamilyInstance"
	elif isinstance(ele,Wall):
		return "WallType"
	elif ele.GetType()==Floor:
		return ele.FloorType
	elif isinstance(ele,RoofBase):
		return "RoofType"
	elif ele.GetType()==Pipe:
		return ele.PipeType
list=[]
# load elements, flatten list and unwrap revit elements
#for i in IN[0]:
	#list.append(UnwrapElement(i))
	
x=[]
y=[]
z=[]
#for i in list:
	#x.append(i.GetType())
	#z.append(returnsymbol(i))
	#y.append(i.Id)

a=UnwrapElement(IN[0])
name=IN[1]
type=a.GetType()
typeid=a.GetTypeId()
sym=doc.GetElement(typeid)
para=sym.Parameter[name].AsString()
#for i in a:
	#x.append(i.Type)


OUT=[type,sym,para]
# ----------------------------------------
categories = Categories("Rooms")
all_elements_of_category = ElementsOfCategory(categories)
code_block_2 = CodeBlock { 10; }
byARGB = Color.ByARGB()
empty = List.Empty()
create = List.Create(arg1=empty)
get_room_infomation = Custom[Get Room Infomation](Rooms=create)  # Get Room Infomation
python_script_2 = Python(IN[0]=create)
# ---------- python_script_2.python (61 lines) ----------
import clr

# Import RevitAPI
clr.AddReference("RevitAPI")
import Autodesk
from Autodesk.Revit.DB import *

# Import DocumentManager and TransactionManager
clr.AddReference("RevitServices")
import RevitServices
from RevitServices.Persistence import DocumentManager
from RevitServices.Transactions import TransactionManager

# Import ToDSType(bool) extension method
clr.AddReference("RevitNodes")
import Revit
clr.ImportExtensions(Revit.Elements)
clr.ImportExtensions(Revit.GeometryConversion)

import clr
clr.AddReference('ProtoGeometry')
from Autodesk.DesignScript.Geometry import *

#The input to this node will be stored in the IN[0] variable.

doc =  DocumentManager.Instance.CurrentDBDocument
app =  DocumentManager.Instance.CurrentUIApplication.Application

rooms = UnwrapElement(IN[0])

output = []
rooms = []
areas = []
boundaries = []
locations = []


for faminst in rooms:
	if faminst.Area > 0:
		area = faminst.Area
		location = faminst.Location.Point.ToPoint()
		boptions = Autodesk.Revit.DB.SpatialElementBoundaryOptions()
		boundsegs = room.GetBoundarySegments(boptions)
		boundcurves = []
		for bound in boundsegs:
			crvs = []
			for seg in bound:
				crv = seg.Curve
				crvs.append(Revit.GeometryConversion.RevitToProtoCurve.ToProtoType( crv, True ))
			boundcurves.append(crvs)
    	
		areas.append(area)
		boundaries.append(boundcurves)
		locations.append(location)

output.append(areas)
output.append(locations)
output.append(boundaries)	
        
#Assign your output to the OUT variable
OUT = output
# ----------------------------------------
select_model_elements = DSModelElementsSelection()  # 6 picked in the model
select_model_element_2 = DSModelElementSelection()  # 1 picked in the model
python_script_3 = Python()
# ---------- python_script_3.python (78 lines) ----------
#Copyright (c) 2015, zhangzbxyz
#Dynamo中文社区 http://dynamochina.com

import clr

clr.AddReference("RevitAPI")
import Autodesk
from Autodesk.Revit.DB import *
from Autodesk.Revit.DB.Plumbing import *
from Autodesk.Revit.DB.Mechanical import *

clr.AddReference("RevitServices")
import RevitServices
from RevitServices.Persistence import DocumentManager

clr.AddReference("RevitNodes")
import Revit

clr.ImportExtensions(Revit.Elements)


def getsymbol(ele):
	if isinstance(ele,FamilyInstance):
		return ele.Symbol
	elif isinstance(ele,Wall):
		return ele.WallType
	elif isinstance(ele,Floor):
		return ele.FloorType
	elif isinstance(ele,RoofBase):
		return ele.RoofType
	elif ele.GetType()==Pipe:
		return ele.PipeType

def getparaval(para):
	ptype=para.StorageType
	if ptype==StorageType.String:
		paravalue=para.AsString()
	else:
		paravalue=para.AsValueString()	
	return paravalue

instlist = UnwrapElement(IN[0])
paranames=IN[1]

doc = DocumentManager.Instance.CurrentDBDocument
output = []
famsyms = []
elementids = []
paraset = []
flag0= 0 if len(paranames)==0 else 1

if flag0:
	for i in range(len(paranames)):
		paraset.append([])

for inst in instlist:
	famsym =getsymbol(inst)
	
	for i in range(len(paranames)):
		instpara= inst.Parameter[paranames[i]]
		fampara=famsym.Parameter[paranames[i]]
		if instpara is not None:
			para=getparaval(instpara)
		elif fampara is not None:
			para=getparaval(fampara)
		else:
			para="no parameter"
		paraset[i].append(para)
			
	famsyms.append(famsym)
	elementids.append(inst.Id.ToString())

output.append(famsyms)
output.append(elementids)
if flag0:
	output.append(paraset)
        
OUT = output
# ----------------------------------------
categories_2 = Categories("AdaptivePoints")
