# Dynamo custom node LunchBox Sheet Collector cn.dyf "LunchBox Sheet Collector" (Dynamo 0.8.0.950)
# category: LunchBox.Revit.Elements
# Collects sheets from the current document

Parameter_Names = Input()
python_script = Python(IN[0]=Parameter_Names)
# ---------- python_script.python (84 lines) ----------
#Copyright(c) 2014, Nathan Miller
# The Proving Ground, http://theprovingground.org

import clr

# Import RevitAPI
clr.AddReference("RevitAPI")
import Autodesk
from Autodesk.Revit.DB import *

# Import DocumentManager and TransactionManager
clr.AddReference("RevitServices")
import RevitServices
from RevitServices.Persistence import DocumentManager
from RevitServices.Transactions import TransactionManager

# Import ToDSType(bool) extension method
clr.AddReference("RevitNodes")
import Revit
clr.ImportExtensions(Revit.Elements)
clr.ImportExtensions(Revit.GeometryConversion)

#The input to this node will be stored in the IN[0] variable.

doc =  DocumentManager.Instance.CurrentDBDocument

def getpara(para):
	ptype=para.StorageType
	if ptype==StorageType.String:
		paravalue=para.AsString()
	else:
		paravalue=para.AsValueString()	
	return paravalue
	
paranames=IN[0]
output = []
sheets = []
flag=0
elementids = []
uniqueids = []
paraset=[]
if paranames is None:
	pass
else:
	flag=1
	
if flag:
	for i in range(len(paranames)):
		paraset.append([])
	
	

collector = FilteredElementCollector(doc)
collector.OfCategory(BuiltInCategory.OST_Sheets)
collector.OfClass(ViewSheet)

famtypeitr = collector.GetElementIdIterator()
famtypeitr.Reset()

for item in famtypeitr:
	elemID = item
	inst = doc.GetElement(elemID)
	sheet=inst
	if flag:
		for i in range(0,len(paranames)):
			paraset[i].append(getpara(inst.Parameter[paranames[i]]))
		
	elementid = inst.Id
	uniqueid = inst.UniqueId
	
	
	sheets.append(sheet)
	elementids.append(elementid)
	uniqueids.append(uniqueid)


output.append(sheets)
output.append(elementids)
output.append(uniqueids)
if flag:
	output.append(paraset)
        
#Assign your output to the OUT variable
OUT = output
# ----------------------------------------
code_block = CodeBlock { 0; 1; 2; 3; }
getItemAtIndex = List.GetItemAtIndex(list=python_script, index=code_block.out0)
Element = Output(getItemAtIndex)
getItemAtIndex_2 = List.GetItemAtIndex(list=python_script, index=code_block.out1)
ElementID = Output(getItemAtIndex_2)
getItemAtIndex_3 = List.GetItemAtIndex(list=python_script, index=code_block.out2)
UniqueID = Output(getItemAtIndex_3)
getItemAtIndex_4 = List.GetItemAtIndex(list=python_script, index=code_block.out3)
Parameters = Output(getItemAtIndex_4)
