# Dynamo custom node LunchBox Wall Element Collector cn.dyf "LunchBox Wall Element Collector" (Dynamo 0.8.0.950)
# category: LunchBox.Revit.Elements
# Collects wall elements from the Revit document.

Toggle = Input()
Wall_Type = Input()
python_script = Python(IN[0]=Toggle, IN[1]=Wall_Type)
# ---------- python_script.python (97 lines) ----------
#Copyright(c) 2014, Nathan Miller
# The Proving Ground, http://theprovingground.org

import clr

# Import RevitAPI
clr.AddReference("RevitAPI")
import Autodesk
from Autodesk.Revit.DB import *

# Import DocumentManager and TransactionManager
clr.AddReference("RevitServices")
import RevitServices
from RevitServices.Persistence import DocumentManager
from RevitServices.Transactions import TransactionManager

# Import ToDSType(bool) extension method
clr.AddReference("RevitNodes")
import Revit
clr.ImportExtensions(Revit.Elements)

#The input to this node will be stored in the IN[0] variable.

doc =  DocumentManager.Instance.CurrentDBDocument
app =  DocumentManager.Instance.CurrentUIApplication.Application

toggle = IN[0]
walltype = IN[1]

output = []
walls = []
locations = []
heights = []
areas = []
levelnames =[]
elementids = []
uniqueids = []

if toggle == True:

	collector = FilteredElementCollector(doc)
	collector.OfCategory(BuiltInCategory.OST_Walls)
	collector.OfClass(Wall)
 
	famtypeitr = collector.GetElementIdIterator()
	famtypeitr.Reset()

	for item in famtypeitr:
		famtypeID = item
		faminst = doc.GetElement(famtypeID)
    
		if walltype is None:
			loc = Revit.GeometryConversion.RevitToProtoCurve.ToProtoType( faminst.Location.Curve, True )
			wall = faminst
    
			#levname = faminst.Parameter['Base Constraint'].AsValueString()
			#height = faminst.Parameter['Unconnected Height'].AsDouble()
			#area = faminst.Parameter['Area'].AsDouble()
			elementid = faminst.Id.ToString()
			uniqueid = faminst.UniqueId
    	
			walls.append(wall)
			locations.append(loc)
			#heights.append(height)
			#areas.append(area)
			#levelnames.append(levname)
			elementids.append(elementid)
			uniqueids.append(uniqueid)    
    	
		elif faminst.WallType.Id == UnwrapElement(walltype).Id:
			loc = Revit.GeometryConversion.RevitToProtoCurve.ToProtoType( faminst.Location.Curve, True )
			wall = faminst
    
			#levname = faminst.Parameter['Base Constraint'].AsValueString()
			#height = faminst.Parameter['Unconnected Height'].AsDouble()
			#area = faminst.Parameter['Area'].AsDouble()
			elementid = faminst.Id.ToString()
			uniqueid = faminst.UniqueId
    	
			walls.append(wall)
			locations.append(loc)
			#heights.append(height)
			#areas.append(area)
			#levelnames.append(levname)
			elementids.append(elementid)
			uniqueids.append(uniqueid)
        
	output.append(walls)
	output.append(locations)
	#output.append(heights)
	#output.append(areas)
	#output.append(levelnames)
	output.append(elementids)
	output.append(uniqueids)
        
#Assign your output to the OUT variable
OUT = output
# ----------------------------------------
number = DoubleInput(0)
getItemAtIndex = List.GetItemAtIndex(list=python_script, index=number)
Element = Output(getItemAtIndex)
solids = Element.Solids(getItemAtIndex, lacing=Longest)
Solid = Output(solids)
number_2 = DoubleInput(1)
getItemAtIndex_2 = List.GetItemAtIndex(list=python_script, index=number_2)
Location_Curve = Output(getItemAtIndex_2)
number_3 = DoubleInput(2)
getItemAtIndex_3 = List.GetItemAtIndex(list=python_script, index=number_3)
高度 = Output(getItemAtIndex_3)
number_4 = DoubleInput(3)
getItemAtIndex_4 = List.GetItemAtIndex(list=python_script, index=number_4)
面积 = Output(getItemAtIndex_4)
number_5 = DoubleInput(4)
getItemAtIndex_5 = List.GetItemAtIndex(list=python_script, index=number_5)
标高 = Output(getItemAtIndex_5)
number_6 = DoubleInput(5)
getItemAtIndex_6 = List.GetItemAtIndex(list=python_script, index=number_6)
ElementID = Output(getItemAtIndex_6)
number_7 = DoubleInput(6)
getItemAtIndex_7 = List.GetItemAtIndex(list=python_script, index=number_7)
Unique_ID = Output(getItemAtIndex_7)
