# Dynamo custom node Get Parameters from Elements.dyf (Dynamo 0.8.0.950)
# category: DynamoChina.Parameter
# Get Parameters from Elements

Elements = Input()
empty = List.Empty()
create = List.Create(Elements, empty)
flatten = Flatten(create)
Parameter_Names = Input()
empty_2 = List.Empty()
create_2 = List.Create(Parameter_Names, empty_2)
flatten_2 = Flatten(create_2)
python_script = Python(IN[0]=flatten, IN[1]=flatten_2)
# ---------- python_script.python (63 lines) ----------
#Copyright (c) 2015, zhangzbxyz
#Dynamo中文社区 http://dynamochina.com

import clr

clr.AddReference("RevitAPI")
import Autodesk
from Autodesk.Revit.DB import *

clr.AddReference("RevitServices")
import RevitServices
from RevitServices.Persistence import DocumentManager

clr.AddReference("RevitNodes")
import Revit

clr.ImportExtensions(Revit.Elements)

def getparaval(para):
	ptype=para.StorageType
	if ptype==StorageType.String:
		paravalue=para.AsString()
	else:
		paravalue=para.AsValueString()	
	return paravalue

instlist = UnwrapElement(IN[0])
paranames=IN[1]

doc = DocumentManager.Instance.CurrentDBDocument
output = []
famsyms = []
elementids = []
paraset = []
flag0= 0 if len(paranames)==0 else 1

if flag0:
	for i in range(len(paranames)):
		paraset.append([])

for inst in instlist:
	famsym =inst.Symbol
	
	for i in range(len(paranames)):
		instpara= inst.Parameter[paranames[i]]
		fampara=famsym.Parameter[paranames[i]]
		if instpara is not None:
			para=getparaval(instpara)
		elif fampara is not None:
			para=getparaval(fampara)
		else:
			para="no parameter"
		paraset[i].append(para)
			
	famsyms.append(famsym)
	elementids.append(inst.Id.ToString())

output.append(famsyms)
output.append(elementids)
if flag0:
	output.append(paraset)
        
OUT = output
# ----------------------------------------
code_block = CodeBlock { 0; 1; 2; }
getItemAtIndex = List.GetItemAtIndex(list=python_script, index=code_block.out0)
FamilySymbol = Output(getItemAtIndex)
getItemAtIndex_2 = List.GetItemAtIndex(list=python_script, index=code_block.out2)
Parameters = Output(getItemAtIndex_2)
getItemAtIndex_3 = List.GetItemAtIndex(list=python_script, index=code_block.out1)
ElementID = Output(getItemAtIndex_3)
