# Dynamo custom node Get Parameters from Walls.dyf (Dynamo 0.8.0.950)
# category: DynamoChina.Parameter
# Get Parameters from Walls

Wall_Types = Input()
empty = List.Empty()
create = List.Create(Wall_Types, empty)
flatten = Flatten(create)
Parameter_Names = Input()
empty_2 = List.Empty()
create_2 = List.Create(Parameter_Names, empty_2)
flatten_2 = Flatten(create_2)
python_script = Python(IN[0]=flatten, IN[1]=flatten_2)
# ---------- python_script.python (100 lines) ----------
#Copyright (c) 2015, zhangzbxyz
#Dynamo中文社区 http://dynamochina.com

import clr

clr.AddReference("RevitAPI")
import Autodesk
from Autodesk.Revit.DB import *

clr.AddReference("RevitServices")
import RevitServices
from RevitServices.Persistence import DocumentManager

clr.AddReference("RevitNodes")
import Revit

clr.ImportExtensions(Revit.Elements)

def getparaval(para):
	ptype=para.StorageType
	if ptype==StorageType.String:
		paravalue=para.AsString()
	else:
		paravalue=para.AsValueString()	
	return paravalue

walltypes = UnwrapElement(IN[0])
paranames=IN[1]

doc = DocumentManager.Instance.CurrentDBDocument
typelist = []
output = []
walls = []
locations = []
elementids = []
paraset = []
flag0= 0 if len(walltypes)==0 else 1
flag1= 0 if len(paranames)==0 else 1

if flag0:
	for item in walltypes:
		typelist.append(item.Id)

if flag1:
	for i in range(len(paranames)):
		paraset.append([])
		
collector = FilteredElementCollector(doc)
collector.OfCategory(BuiltInCategory.OST_Walls)
collector.OfClass(Wall)

famtypeiditr = collector.GetElementIdIterator()
famtypeiditr.Reset()

for item in famtypeiditr:
	inst = doc.GetElement(item)
	famsym =inst.WallType
	if flag0==0:
		loc = Revit.GeometryConversion.RevitToProtoCurve.ToProtoType(inst.Location.Curve, True )
		if flag1:
			for i in range(len(paranames)):
				instpara= inst.Parameter[paranames[i]]
				fampara=famsym.Parameter[paranames[i]]
				if instpara is not None:
					para=getparaval(instpara)
				elif fampara is not None:
					para=getparaval(fampara)
				else:
					para=None
				paraset[i].append(para)

		walls.append(inst)
		locations.append(loc)
		elementids.append(inst.Id.ToString())  
	
	elif inst.WallType.Id in typelist:
		loc = Revit.GeometryConversion.RevitToProtoCurve.ToProtoType(inst.Location.Curve, True )
		if flag1:
			for i in range(len(paranames)):
				instpara= inst.Parameter[paranames[i]]
				fampara=famsym.Parameter[paranames[i]]
				if instpara is not None:
					para=getparaval(instpara)
				elif fampara is not None:
					para=getparaval(fampara)
				else:
					para="no parameter"
				paraset[i].append(para)
				
		walls.append(inst)
		locations.append(loc)
		elementids.append(inst.Id.ToString())

output.append(walls)
output.append(locations)
output.append(elementids)
if flag1:
	output.append(paraset)	
        
OUT = output
# ----------------------------------------
code_block = CodeBlock { 0; 1; 2; 3; }
getItemAtIndex = List.GetItemAtIndex(list=python_script, index=code_block.out0)
Element = Output(getItemAtIndex)
solids = Element.Solids(getItemAtIndex, lacing=Longest)
Solid = Output(solids)
getItemAtIndex_2 = List.GetItemAtIndex(list=python_script, index=code_block.out1)
Location_Curve = Output(getItemAtIndex_2)
getItemAtIndex_3 = List.GetItemAtIndex(list=python_script, index=code_block.out2)
ElementID = Output(getItemAtIndex_3)
getItemAtIndex_4 = List.GetItemAtIndex(list=python_script, index=code_block.out3)
Parameters = Output(getItemAtIndex_4)
