# Dynamo custom node Select in Revit.dyf (Dynamo 0.8.0.950)
# category: DME.Revit
# Select given Element(s), ElementId(s) or element id(s) as string(s) in Revit

Element_s = Input()  # "Element(s)"
python_script = Python(IN[0]=Element_s)
# ---------- python_script.python (37 lines) ----------
import clr

# Import RevitAPI
clr.AddReference("RevitAPI")
clr.AddReference('RevitAPIUI')
import Autodesk
from Autodesk.Revit.DB import *

# Import DocumentManager and TransactionManager
clr.AddReference("RevitServices")
import RevitServices
from RevitServices.Persistence import DocumentManager
from RevitServices.Transactions import TransactionManager

def addToSet(doc, set, element):
	try:
		el = doc.GetElement(element)
	except:
		el = element
	set.Add(el)


elements = UnwrapElement(IN[0])

doc =  DocumentManager.Instance.CurrentDBDocument
app =  DocumentManager.Instance.CurrentUIDocument
set = Autodesk.Revit.UI.Selection.SelElementSet.Create()

try:
	for el in elements:
		addToSet(doc, set, el)
except:
	addToSet(doc, set, elements)

app.Selection.Elements = set

OUT = app.Selection
# ----------------------------------------
Selection = Output(python_script)
