# Dynamo custom node TwistedDegree.dyf (Dynamo 0.7.1.17276)
# category: ArchGeek.Test

BaseNumber = Input()
BaseDegree = Input()
code_block = CodeBlock(BaseLevel=BaseNumber, BaseDegree=BaseDegree) { 0..#BaseLevel..BaseDegree; }
code_block_2 = CodeBlock(a=BaseNumber, b=BaseDegree) { a*b; }
SecondNumber = Input()
SecondDegree = Input()
code_block_3 = CodeBlock(SecondBegin=code_block_2, SecondLevel=SecondNumber, SecondDegree=SecondDegree)
# ---------- code_block_3.designscript (2 lines) ----------
SecondBegin..
#SecondLevel..SecondDegree;
# ----------------------------------------
code_block_4 = CodeBlock(a=code_block_2, b=SecondNumber, c=SecondDegree) { a+b*c; }
ThirdNumber = Input()
ThirdDegree = Input()
code_block_5 = CodeBlock(ThirdBegin=code_block_4, ThirdLevel=ThirdNumber, ThirdDegree=ThirdDegree)
# ---------- code_block_5.designscript (2 lines) ----------
ThirdBegin..
#ThirdLevel..ThirdDegree;
# ----------------------------------------
code_block_6 = CodeBlock(a=code_block_4, b=ThirdNumber, c=ThirdDegree) { a+b*c; }
ForthNumber = Input()
FouthDegree = Input()
code_block_7 = CodeBlock(FouthBegin=code_block_6, ForthLevel=ForthNumber, FouthDegree=FouthDegree)
# ---------- code_block_7.designscript (2 lines) ----------
FouthBegin..
#ForthLevel..FouthDegree;
# ----------------------------------------
create = List.Create(code_block, code_block_3, code_block_5, code_block_7)
flatten = Flatten(create)
TwistedDegreeList = Output(flatten)
