# Dynamo custom node create floors.dyf (Dynamo 0.8.0.950)
# category: DynamoChina

categories = Categories("Rooms")
all_elements_of_category = ElementsOfCategory(categories)
string = StringInput("名称")
getParameterValueByName = Element.GetParameterValueByName(element=all_elements_of_category, parameterName=string)
Input = Input()
code_block = CodeBlock(x=Input) { x[0]; x[1]; }
eq = getParameterValueByName == code_block.out0
filterByBoolMask = List.FilterByBoolMask(list=all_elements_of_category, mask=eq)
python_script = Python(IN[0]=filterByBoolMask.in)
# ---------- python_script.python (57 lines) ----------
#Copyright (c) 2015, zhangzbxyz
#Dynamo中文社区 http://dynamochina.com
import clr

# Import RevitAPI
clr.AddReference("RevitAPI")
import Autodesk
from Autodesk.Revit.DB import *

# Import DocumentManager and TransactionManager
clr.AddReference("RevitServices")
import RevitServices
from RevitServices.Persistence import DocumentManager
from RevitServices.Transactions import TransactionManager

# Import ToDSType(bool) extension method
clr.AddReference("RevitNodes")
import Revit
clr.ImportExtensions(Revit.Elements)
clr.ImportExtensions(Revit.GeometryConversion)

import clr
clr.AddReference('ProtoGeometry')
from Autodesk.DesignScript.Geometry import *

rooms = UnwrapElement(IN[0])

output = []
areas = []
boundaries = []
locations = []
levels=[]

for faminst in rooms:
	area = faminst.Area
	location = faminst.Location.Point.ToPoint()
	boptions = Autodesk.Revit.DB.SpatialElementBoundaryOptions()
	boundsegs = faminst.GetBoundarySegments(boptions)
	boundcurves = []
	for bound in boundsegs:
		crvs = []
		for seg in bound:
			crv = seg.Curve
			crvs.append(Revit.GeometryConversion.RevitToProtoCurve.ToProtoType(crv,True))
		boundcurves.append(crvs)
	levels.append(faminst.Level)	
	areas.append(area)
	boundaries.append(boundcurves)
	locations.append(location)


output.append(areas)
output.append(locations)
output.append(boundaries)	
output.append(levels)
#Assign your output to the OUT variable
OUT = output
# ----------------------------------------
number = DoubleInput(2)
getItemAtIndex = List.GetItemAtIndex(list=python_script, index=number)
number_2 = DoubleInput(1)
flatten = List.Flatten(list=getItemAtIndex, amt=number_2)
byName = FloorType.ByName(code_block.out1)
number_3 = DoubleInput(3)
getItemAtIndex_2 = List.GetItemAtIndex(list=python_script, index=number_3)
python_script_2 = Python(IN[0]=flatten, IN[1]=byName, IN[2]=getItemAtIndex_2)
# ---------- python_script_2.python (56 lines) ----------
import clr
clr.AddReference('ProtoGeometry')
from Autodesk.DesignScript.Geometry import *


clr.AddReference('RevitAPI')
import Autodesk
from Autodesk.Revit.DB import *

clr.AddReference('RevitServices')
import RevitServices
from RevitServices.Persistence import DocumentManager
from RevitServices.Transactions import TransactionManager

clr.AddReference('RevitNodes')
import Revit
clr.ImportExtensions(Revit.Elements)
clr.ImportExtensions(Revit.GeometryConversion)
import Revit.Elements

_curves = IN[0]
floortype = UnwrapElement(IN[1])
_level =IN[2]

levels=[]
curves=[]
floors=[]
arrays=[]

doc = DocumentManager.Instance.CurrentDBDocument
uiapp = DocumentManager.Instance.CurrentUIApplication
app = uiapp.Application


try:
	for i in range(len(_level)):
		levels.append(UnwrapElement(_level[i]))
		curves.append(UnwrapElement(_curves[i]))
except:
	levels.append(UnwrapElement(_level))
	curves.append(UnwrapElement(_curves))
	

for curve in curves:
	array=Autodesk.Revit.DB.CurveArray()
	for item in curve:
		array.Append(item.ToRevitType())
	arrays.append(array)

TransactionManager.Instance.EnsureInTransaction(doc)
for i in range(len(_level)):
	floor = doc.Create.NewFloor(arrays[i],floortype,levels[i],True)
	floors.append(floor)
TransactionManager.Instance.TransactionTaskDone()

OUT=floors
# ----------------------------------------
