# Dynamo graph curtainsystem.dyn (Dynamo 0.8.2.2073)

select_model_element = DSModelElementSelection()  # 1 picked in the model
get_curtaingrid = Custom[Get Curtaingrid](CurtainSystem=select_model_element)
python_script = Python(IN[0]=select_model_element)
# ---------- python_script.python (50 lines) ----------
#Copyright (c) 2015, zhangzbxyz
#Dynamo中文社区 http://dynamochina.com

import clr

clr.AddReference("RevitAPI")
import Autodesk
from Autodesk.Revit.DB import *

clr.AddReference("RevitServices")
import RevitServices
from RevitServices.Persistence import DocumentManager

clr.AddReference("RevitNodes")
import Revit


clr.ImportExtensions(Revit.Elements)
clr.ImportExtensions(Revit.GeometryConversion)

doc = DocumentManager.Instance.CurrentDBDocument
input=UnwrapElement(IN[0])

uls=[]
vls=[]
ulset=[]
vlset=[]

cgset=input.CurtainGrids

for i in cgset:
	ulids=i.GetUGridLineIds()
	vlids=i.GetVGridLineIds()
	for ulid in ulids:
		ul=doc.GetElement(ulid)
		uline=ul.FullCurve.ToProtoType()
		uls.append(uline)
	for vlid in vlids:
		vl=doc.GetElement(vlid)
		vline=vl.FullCurve.ToProtoType()
		vls.append(vline)        
	ulset.append(uls)
	vlset.append(vls)
        
#gset=input.Geometry
gs=[]
#for i in gset:
	#gs.append(i)
        
OUT = [ulset,vlset,gs]
# ----------------------------------------
code_block = CodeBlock(x=python_script) { x[1]; }
flatten = Flatten(code_block)
code_block_2 = CodeBlock(x=python_script) { x[0]; }
flatten_2 = Flatten(code_block_2)
geometry = Element.Geometry(select_model_element)
boundingBox = Element.BoundingBox(select_model_element)
curves = Element.Curves(select_model_element)
elementCurveReferences = Element.ElementCurveReferences(select_model_element)
solids = Element.Solids(select_model_element)
boundaries = CurtainPanel.Boundaries()
