# Dynamo graph element in room.dyn (Dynamo 0.8.0.950)

select_model_elements = DSModelElementsSelection()  # 16 picked in the model
categories = Categories("Rooms")
all_elements_of_category = ElementsOfCategory(categories)
python_script = Python(IN[0]=select_model_elements, IN[1]=all_elements_of_category)
# ---------- python_script.python (48 lines) ----------
"""
Copyright Peter Kompolschek 2015
finds elements in rooms
"""
import sys
import clr
clr.AddReference('ProtoGeometry')
from Autodesk.DesignScript.Geometry import *
# Import ToDSType(bool) extension method
clr.AddReference("RevitNodes")
import Revit
clr.ImportExtensions(Revit.Elements)
# Import geometry conversion extension methods
clr.ImportExtensions(Revit.GeometryConversion)
# Import DocumentManager and TransactionManager

from System.Collections.Generic import *
# Import RevitAPI
clr.AddReference("RevitAPI")
import Autodesk
from Autodesk.Revit.DB import *
#initialise lists and parameters
#librarypaths

#lists
families = []
elements=[]
rooms=[]
roomlist=[]

#external functions

# load elements, flatten list and unwrap revit elements
elements=UnwrapElement(IN[0])
rooms=UnwrapElement(IN[1])
	
for ele in elements:
	point= ele.Location.Point
	flag=0
	for room in rooms:
		if room.IsPointInRoom(point):
			#fmly=family.GetType().Name
			roomlist.append(room.Id.ToString())
			flag=1
	if flag==0:
		roomlist.append(0)

OUT=roomlist
# ----------------------------------------
