# Dynamo graph excel ceshi.dyn (Dynamo 0.8.0.950)

file_path = Filename("D:\Domain_Users_Documents\zhangzebin\桌面\房间布置1.xlsx")
fromPath = FileObject(file_path)  # "File.FromPath"
string = StringInput("Sheet1")
readFromFile = Excel.ReadFromFile(fromPath, string)
number = DoubleInput(1)
getItemAtIndex = List.GetItemAtIndex(list=readFromFile, index=number)
number_2 = DoubleInput(0)
getItemAtIndex_2 = List.GetItemAtIndex(list=readFromFile, index=number_2)
create = List.Create(getItemAtIndex, getItemAtIndex_2)
transpose = List.Transpose(create)
map = List.Map(list=transpose)
create_floor_of_rooms = Custom[Create Floor of Rooms]()  # Create Floor of Rooms
