# Dynamo graph floor by roomname.dyn (Dynamo 0.8.0.950)

categories = Categories("AdaptivePoints")
all_elements_of_category = ElementsOfCategory(categories)
string = StringInput("名称")
getParameterValueByName = Element.GetParameterValueByName()
eq = _ == _
filterByBoolMask = List.FilterByBoolMask(mask=eq)
select_model_element = DSModelElementSelection()  # 1 picked in the model
empty = List.Empty()
create = List.Create(select_model_element, empty)
flatten = Flatten(create)
python_script = Python(IN[0]=flatten)
# ---------- python_script.python (48 lines) ----------
import clr

# Import RevitAPI
clr.AddReference("RevitAPI")
import Autodesk
from Autodesk.Revit.DB import *

# Import DocumentManager and TransactionManager
clr.AddReference("RevitServices")
import RevitServices
from RevitServices.Persistence import DocumentManager
from RevitServices.Transactions import TransactionManager

# Import ToDSType(bool) extension method
clr.AddReference("RevitNodes")
import Revit
clr.ImportExtensions(Revit.Elements)
clr.ImportExtensions(Revit.GeometryConversion)

import clr
clr.AddReference('ProtoGeometry')
from Autodesk.DesignScript.Geometry import *

rooms = UnwrapElement(IN[0])

output = []
areas = []
boundaries = []
locations = []
levels=[]

for faminst in rooms:
	boptions = Autodesk.Revit.DB.SpatialElementBoundaryOptions()
	boundsegs = faminst.GetBoundarySegments(boptions)
	boundcurves = []
	for bound in boundsegs:
		crvs = []
		for seg in bound:
			crv = seg.Curve
			crvs.append(Revit.GeometryConversion.RevitToProtoCurve.ToProtoType(crv,True))
		boundcurves.append(crvs)
	levels.append(faminst.Level)	
	boundaries.append(boundcurves)

output.append(boundaries)	
output.append(levels)
#Assign your output to the OUT variable
OUT = output
# ----------------------------------------
code_block = CodeBlock { 1; 2; 3; 0; }
getItemAtIndex = List.GetItemAtIndex(list=python_script, index=code_block.out3)
flatten_2 = List.Flatten(list=getItemAtIndex, amt=code_block.out1)
floor_types = FloorTypes("标准木材-木质面层")
getItemAtIndex_2 = List.GetItemAtIndex(list=python_script, index=code_block.out0)
byOutlineTypeAndLevel = Floor.ByOutlineTypeAndLevel(outlineCurves=flatten_2, floorType=floor_types, level=getItemAtIndex_2)
string_2 = StringInput("自标高的高度偏移")
string_3 = StringInput("厚度")
getParameterValueByName_2 = Element.GetParameterValueByName(element=byOutlineTypeAndLevel, parameterName=string_3)
setParameterByName = Element.SetParameterByName(element=byOutlineTypeAndLevel, parameterName=string_2, value=getParameterValueByName_2)
