# Dynamo graph get parameter.dyn (Dynamo 0.8.0.950)

select_model_element = DSModelElementSelection()  # 1 picked in the model
code_block = CodeBlock { {"标高","主体材质"}; }
get_parameter_from_element = Custom[Get Parameter from Element](Elements=select_model_element, Parameter_Names=code_block)  # Get Parameter from Element
wall_types = WallTypes("常规 - 200mm")
code_block_2 = CodeBlock { "粗略比例填式"; }
get_parameter_from_wall = Custom[Get Parameter from Wall](Wall_Types=wall_types, Parameter_Names=code_block_2)
select_model_element_2 = DSModelElementSelection()  # 1 picked in the model
create = List.Create(select_model_element, select_model_element_2)
python_script = Python(IN[0]=create, IN[1]=code_block)
# ---------- python_script.python (63 lines) ----------
#Copyright (c) 2015, zhangzbxyz
#Dynamo中文社区 http://dynamochina.com

import clr

clr.AddReference("RevitAPI")
import Autodesk
from Autodesk.Revit.DB import *

clr.AddReference("RevitServices")
import RevitServices
from RevitServices.Persistence import DocumentManager

clr.AddReference("RevitNodes")
import Revit

clr.ImportExtensions(Revit.Elements)

def getparaval(para):
	ptype=para.StorageType
	if ptype==StorageType.String:
		paravalue=para.AsString()
	else:
		paravalue=para.AsValueString()	
	return paravalue

instlist = UnwrapElement(IN[0])
paranames=IN[1]

doc = DocumentManager.Instance.CurrentDBDocument
output = []
famsyms = []
elementids = []
paraset = []
flag0= 0 if len(paranames)==0 else 1

if flag0:
	for i in range(len(paranames)):
		paraset.append([])

for inst in instlist:
	famsym =inst.Symbol
	
	for i in range(len(paranames)):
		instpara= inst.Parameter[paranames[i]]
		fampara=famsym.Parameter[paranames[i]]
		if instpara is not None:
			para=getparaval(instpara)
		elif fampara is not None:
			para=getparaval(fampara)
		else:
			para="no parameter"
		paraset[i].append(para)
			
	famsyms.append(famsym)
	elementids.append(inst.Id.ToString())

output.append(famsyms)
output.append(elementids)
if flag0:
	output.append(paraset)
        
OUT = output
# ----------------------------------------
