# Dynamo graph luoxuan.dyn (Dynamo 0.8.1.1823)

code_block = CodeBlock { 100; }
code_block_2 = CodeBlock { 1; 100; 0.1; }
number_sequence = NumberSeq(code_block_2.out0, code_block_2.out1, code_block_2.out2, lacing=Longest)
mul = code_block * number_sequence  # lacing=Longest
sin = Math.Sin(mul, lacing=Longest)
mul_2 = sin * number_sequence  # lacing=Longest
cos = Math.Cos(mul, lacing=Longest)
mul_3 = cos * number_sequence  # lacing=Longest
byCoordinates = Point.ByCoordinates(x=mul_2, y=mul_3, z=number_sequence, lacing=Longest)
byPoints = PolyCurve.ByPoints(points=byCoordinates)
