# Dynamo graph luoxuanxian.dyn (Dynamo 0.8.1.1823)

code_block = CodeBlock { 1..5; }
byCoordinates = Point.ByCoordinates(x=code_block)
XAxis = Vector.XAxis()
code_block_2 = CodeBlock { 0; 10; 10; }
byCoordinates_2 = Point.ByCoordinates(x=code_block, y=code_block_2.out1, z=code_block_2.out2)
code_block_3 = CodeBlock { 360; }
byAxis = Helix.ByAxis(byCoordinates, XAxis, byCoordinates_2, arg4=code_block_3)
angle = Helix.Angle(byAxis)
axisDirection = Helix.AxisDirection(byAxis)
