# Dynamo graph poly.dyn (Dynamo 0.8.1.1823)

code_block = CodeBlock { flase; }
code_block_2 = CodeBlock { Point.ByCoordinates(0,2,3); Point.ByCoordinates(0,5,4); Point.ByCoordinates(0,6,7); Point.ByCoordinates(4,8,9); }
create = List.Create(code_block_2.out0, code_block_2.out1, code_block_2.out2, code_block_2.out3)
boolean = BoolSelector(true)
byPoints = PolyCurve.ByPoints(points=create, connectLastToFirst=boolean)
curves = PolyCurve.Curves(byPoints)
byCurve = ModelCurve.ByCurve(curves)
