# Dynamo graph room boundaries.dyn (Dynamo 0.8.0.950)

select_model_element = DSModelElementSelection()  # 1 picked in the model
python_script = Python(IN[0]=select_model_element)
# ---------- python_script.python (41 lines) ----------
"""
Copyright Peter Kompolschek 2015
finds elements in rooms
"""
import sys
import clr
clr.AddReference('ProtoGeometry')
from Autodesk.DesignScript.Geometry import *
# Import ToDSType(bool) extension method
clr.AddReference("RevitNodes")
import Revit
clr.ImportExtensions(Revit.Elements)
# Import geometry conversion extension methods
clr.ImportExtensions(Revit.GeometryConversion)
# Import DocumentManager and TransactionManager
clr.AddReference("RevitServices")
import RevitServices
from RevitServices.Persistence import DocumentManager
from RevitServices.Transactions import TransactionManager
from System.Collections.Generic import *
# Import RevitAPI
clr.AddReference("RevitAPI")
import Autodesk
from Autodesk.Revit.DB import *
#initialise lists and parameters
#librarypaths

doc =  DocumentManager.Instance.CurrentDBDocument
app =  DocumentManager.Instance.CurrentUIApplication.Application

#external functions

# load elements, flatten list and unwrap revit elements
a=UnwrapElement(IN[0])
x=a.GetType()

#for i in a:
	#x.append(i.Type)


OUT=x
# ----------------------------------------
categories = Categories("Rooms")
all_elements_of_category = ElementsOfCategory(categories)
element_types = ElementTypes("Material")
all_elements_of_type = ElementsOfType(element_types)
code_block = CodeBlock { 10; }
byARGB = Color.ByARGB()
create = List.Create(select_model_element)
get_room_infomation = Custom[Get Room Infomation](Rooms=create)  # Get Room Infomation
python_script_2 = Python(IN[0]=create)
# ---------- python_script_2.python (54 lines) ----------
import clr

# Import RevitAPI
clr.AddReference("RevitAPI")
import Autodesk
from Autodesk.Revit.DB import *

# Import DocumentManager and TransactionManager
clr.AddReference("RevitServices")
import RevitServices
from RevitServices.Persistence import DocumentManager
from RevitServices.Transactions import TransactionManager

# Import ToDSType(bool) extension method
clr.AddReference("RevitNodes")
import Revit
clr.ImportExtensions(Revit.Elements)
clr.ImportExtensions(Revit.GeometryConversion)

import clr
clr.AddReference('ProtoGeometry')
from Autodesk.DesignScript.Geometry import *

rooms = UnwrapElement(IN[0])

output = []
rooms = []
areas = []
boundaries = []
locations = []

for faminst in rooms:
	area = faminst.Area
	location = faminst.Location.Point.ToPoint()
	boptions = Autodesk.Revit.DB.SpatialElementBoundaryOptions()
	boundsegs = room.GetBoundarySegments(boptions)
	boundcurves = []
	for bound in boundsegs:
		crvs = []
		for seg in bound:
			crv = seg.Curve
			crvs.append(Revit.GeometryConversion.RevitToProtoCurve.ToProtoType(crv,True))
		boundcurves.append(crvs)
		
	areas.append(area)
	boundaries.append(boundcurves)
	locations.append(location)

output.append(areas)
output.append(locations)
output.append(boundaries)	
        
#Assign your output to the OUT variable
OUT = output
# ----------------------------------------
empty = List.Empty()
filterByBoolMask = List.FilterByBoolMask()
