# Dynamo graph textnote.dyn (Dynamo 0.8.0.950)

python_script = Python()
# ---------- python_script.python (38 lines) ----------
import clr
clr.AddReference('ProtoGeometry')
from Autodesk.DesignScript.Geometry import *

# Import RevitAPI
clr.AddReference('RevitAPI')
import Autodesk

# Import DocumentManager and TransactionManager
clr.AddReference('RevitServices')
import RevitServices
from RevitServices.Persistence import DocumentManager
from RevitServices.Transactions import TransactionManager

# Import ToDSType(bool) extension method
clr.AddReference('RevitNodes')
import Revit
clr.ImportExtensions(Revit.Elements)

walls = UnwrapElement(IN[0])
pipes = UnwrapElement(IN[1])
windowfamily = UnwrapElement(IN[2])
guanjing = IN[3]

doc = DocumentManager.Instance.CurrentDBDocument
uiapp = DocumentManager.Instance.CurrentUIApplication
app = uiapp.Application
TransactionManager.Instance.EnsureInTransaction(doc)



	SillHeight = start2.Z-start1.Z-guanjingx/2-0.082
	famInst = doc.Create.NewFamilyInstance(location, windowfamily, wall, Autodesk.Revit.DB.Structure.StructuralType.NonStructural)
	famInst.get_Parameter('底高度').Set(SillHeight)
	famInst.get_Parameter('管道直径').Set(guanjingx)

# End Transaction
TransactionManager.Instance.TransactionTaskDone()
# ----------------------------------------
