# Dynamo graph 全自动开洞（加循环） (1).dyn (Dynamo 0.8.1.1417)

categories = Categories("Walls")
all_elements_of_category = ElementsOfCategory(categories)
create = List.Create(all_elements_of_category)
flatten = Flatten(create)
id = Category.Id(all_elements_of_category)
选择墙文本 = Filename("C:\Users\Administrator\Desktop\全自动开洞测试\墙.txt")
fromPath = FileObject(选择墙文本)  # "File.FromPath"
readText = File.ReadText(fromPath)
code_block = CodeBlock { ","; }
split = String.Split(readText, code_block)
toNumber = String.ToNumber(split)
allIndicesOf = List.AllIndicesOf(list=id, item=toNumber)
flatten_2 = Flatten(allIndicesOf)
getItemAtIndex = List.GetItemAtIndex(list=flatten, index=flatten_2)
categories_2 = Categories("PipeCurves")
all_elements_of_category_2 = ElementsOfCategory(categories_2)
create_2 = List.Create(all_elements_of_category_2)
flatten_3 = Flatten(create_2)
id_2 = Category.Id(all_elements_of_category_2)
选择管道文本 = Filename("C:\Users\Administrator\Desktop\全自动开洞测试\管道.txt")
fromPath_2 = FileObject(选择管道文本)  # "File.FromPath"
readText_2 = File.ReadText(fromPath_2)
split_2 = String.Split(readText_2, code_block)
toNumber_2 = String.ToNumber(split_2)
allIndicesOf_2 = List.AllIndicesOf(list=id_2, item=toNumber_2)
flatten_4 = Flatten(allIndicesOf_2)
getItemAtIndex_2 = List.GetItemAtIndex(list=flatten_3, index=flatten_4)
family_types = FamilyTypes("开洞族:类型 1")
根据管道XX参数计算洞口大小 = CodeBlock { "外径"; }
getParameterValueByName = Element.GetParameterValueByName(element=getItemAtIndex_2, parameterName=根据管道XX参数计算洞口大小)
convert_between_units = DynamoConvert(getParameterValueByName, conversionMetric=Length, conversionFrom=Feet, conversionTo=Meters)
python_script = Python(IN[0]=getItemAtIndex, IN[1]=getItemAtIndex_2, IN[2]=family_types, IN[3]=convert_between_units)
# ---------- python_script.python (73 lines) ----------
import clr
clr.AddReference('ProtoGeometry')
from Autodesk.DesignScript.Geometry import *

# Import RevitAPI
clr.AddReference('RevitAPI')
import Autodesk

# Import DocumentManager and TransactionManager
clr.AddReference('RevitServices')
import RevitServices
from RevitServices.Persistence import DocumentManager
from RevitServices.Transactions import TransactionManager

# Import ToDSType(bool) extension method
clr.AddReference('RevitNodes')
import Revit
clr.ImportExtensions(Revit.Elements)

walls = UnwrapElement(IN[0])
pipes = UnwrapElement(IN[1])
windowfamily = UnwrapElement(IN[2])
guanjing = IN[3]

doc = DocumentManager.Instance.CurrentDBDocument
uiapp = DocumentManager.Instance.CurrentUIApplication
app = uiapp.Application
TransactionManager.Instance.EnsureInTransaction(doc)

#search for existing windows and delete
#elList = wall.FindInserts(True, False, False, False)
#for elemId in elList:
#	doc.Delete(elemId)
# extract wall geometry and calculate middlepoint
for i in range (0,len(walls)):

	wall = walls[i]
	pipe = pipes[i]
	guanjingx = guanjing[i]/0.3048
	locCurve1 = wall.Location
	locCurve2 = pipe.Location

	start1 = locCurve1.Curve.GetEndPoint(0)
	end1 = locCurve1.Curve.GetEndPoint(1)
	start2 = locCurve2.Curve.GetEndPoint(0)
	end2 = locCurve2.Curve.GetEndPoint(1)

	x1 = start1.X
	y1 = start1.Y
	x2 = end1.X
	y2 = end1.Y
	x3 = start2.X
	y3 = start2.Y
	x4 = end2.X
	y4 = end2.Y

	a = (y1 - y2) / (x1 - x2)
	b = (x1 * y2 - x2 * y1) / (x1 - x2)
	c = (y3 - y4) / (x3 - x4)
	d = (x3 * y4 - x4 * y3) / (x3 - x4)

	xx = ((x1 - x2) * (x3 * y4 - x4 * y3) - (x3 - x4) * (x1 * y2 - x2 * y1))/ ((x3 - x4) * (y1 - y2) - (x1 - x2) * (y3 - y4))
	yy = ((y1 - y2) * (x3 * y4 - x4 * y3) - (x1 * y2 - x2 * y1) * (y3 - y4))/ ((y1 - y2) * (x3 - x4) - (x1 - x2) * (y3 - y4))

	location = Autodesk.Revit.DB.XYZ(xx,yy,start1.Z)

	SillHeight = start2.Z-start1.Z-guanjingx/2-0.082
	famInst = doc.Create.NewFamilyInstance(location, windowfamily, wall, Autodesk.Revit.DB.Structure.StructuralType.NonStructural)
	famInst.get_Parameter('底高度').Set(SillHeight)
	famInst.get_Parameter('管道直径').Set(guanjingx)

# End Transaction
TransactionManager.Instance.TransactionTaskDone()
# ----------------------------------------
