# Dynamo graph 加面层（法向向量）.dyn (Dynamo 0.8.2.1530)

select_face = DSFaceSelection()  # 1 picked in the model
perimeterCurves = Surface.PerimeterCurves(select_face)
flatten = Flatten(perimeterCurves)
code_block = CodeBlock { 0.5; }
pointAtParameter = Curve.PointAtParameter(curve=perimeterCurves, param=code_block)
Z = Point.Z(pointAtParameter)
flatten_2 = Flatten(Z)
minimumItem = List.MinimumItem(Z)
eq = _ == minimumItem
map = List.Map(list=flatten_2, f_x=eq)
flatten_3 = Flatten(map)
filterByBoolMask = List.FilterByBoolMask(list=flatten, mask=flatten_3)
flatten_4 = Flatten(pointAtParameter)
filterByBoolMask_2 = List.FilterByBoolMask(list=flatten_4, mask=flatten_3)
normalAtPoint = Surface.NormalAtPoint(surface=select_face, point=filterByBoolMask_2.in)
code_block_2 = CodeBlock { 0.15; }
translate = Geometry.Translate(geometry=filterByBoolMask.in, direction=normalAtPoint, distance=code_block_2)
code_block_3 = CodeBlock { 1; }
levels = Levels("1F")
wall_types = WallTypes("CW 102-85-100p")
byCurveAndHeight = Wall.ByCurveAndHeight(curve=translate, height=code_block_3, level=levels, wallType=wall_types)
code_block_4 = CodeBlock { "无连接高度"; }
maximumItem = List.MaximumItem(Z)
code_block_5 = CodeBlock(a=maximumItem, b=minimumItem) { a-b; }
setParameterByName = Element.SetParameterByName(element=byCurveAndHeight, parameterName=code_block_4, value=code_block_5)
