# Dynamo graph 墙加面层.dyn (Dynamo 0.7.6.3387)

select_face = DSFaceSelection()  # 1 picked in the model
perimeterCurves = Surface.PerimeterCurves(select_face)
flatten = Flatten(perimeterCurves)
code_block = CodeBlock { 0.5; }
pointAtParameter = Curve.PointAtParameter(perimeterCurves, code_block)
Z = Point.Z(pointAtParameter)
flatten_2 = Flatten(Z)
minimumItem = List.MinimumItem(Z)
eq = _ == minimumItem
map = List.Map(flatten_2, eq)
flatten_3 = Flatten(map)
filterByBoolMask = List.FilterByBoolMask(flatten, flatten_3)
code_block_2 = CodeBlock { 0.15; }
offset = Curve.Offset(filterByBoolMask, code_block_2)
code_block_3 = CodeBlock { 1; }
levels = Levels("标高 1")
wall_types = WallTypes("CW 102-85-100p")
byCurveAndHeight = Wall.ByCurveAndHeight(offset, code_block_3, levels, wall_types)
code_block_4 = CodeBlock { "无连接高度"; }
select_model_element = DSModelElementSelection()  # 1 picked in the model
getParameterValueByName = Element.GetParameterValueByName(select_model_element, code_block_4)
setParameterByName = Element.SetParameterByName(byCurveAndHeight, code_block_4, getParameterValueByName)
