# Dynamo graph 将空注释的模型注释为红色.dyn (Dynamo 0.8.1.830)

categories = Categories("Walls")
all_elements_of_category = ElementsOfCategory(categories)
code_block = CodeBlock { "注释"; }
getParameterValueByName = Element.GetParameterValueByName(element=all_elements_of_category, parameterName=code_block)
code_block_2 = CodeBlock { ""; }
boolean = BoolSelector(true)
contains = String.Contains(str=getParameterValueByName, searchFor=code_block_2, ignoreCase=boolean)
formula = Formula("if(x==a,true,false)", x=getParameterValueByName, a=code_block_2)
filterByBoolMask = List.FilterByBoolMask(list=all_elements_of_category, mask=formula)
code_block_3 = CodeBlock { 0; }
code_block_4 = CodeBlock { 255; }
byARGB = Color.ByARGB(a=code_block_3, r=code_block_4, g=code_block_3, b=code_block_3)
overrideColorInView = Element.OverrideColorInView(element=filterByBoolMask.in, color=byARGB)
