# Dynamo graph 成组随机和组内随机.dyn (Dynamo 0.7.6.3557)

code_block = CodeBlock { 0..#10..1; }
byCoordinates = Point.ByCoordinates(code_block, code_block, lacing=CrossProduct)
code_block_2 = CodeBlock { 0.1; }
code_block_3 = CodeBlock { 0.5; }
number_slider = DoubleSlider(100, range=100..200 step 0.01)
number_slider_2 = DoubleSlider(25.29, range=0..100 step 0.01)
lunchbox_random_numbers = Custom[LunchBox Random Numbers](Min=code_block_2, Max=code_block_3, Amount=number_slider, Seed=number_slider_2)  # Generates a list of Random numbers using a domain, amount, and seed.
code_block_4 = CodeBlock { 10; }
chop = List.Chop(lunchbox_random_numbers, code_block_4)
byCenterPointRadius = Circle.ByCenterPointRadius(byCoordinates, chop)
code_block_5 = CodeBlock { 0..#10..1; }
byCoordinates_2 = Point.ByCoordinates(code_block_5, code_block_5, lacing=CrossProduct)
flatten = Flatten(byCoordinates_2)
count = List.Count(flatten)
code_block_6 = CodeBlock(x=count) { 0..0.45..#x; }
code_block_7 = CodeBlock { 10; }
chop_2 = List.Chop(code_block_6, code_block_7)
byCenterPointRadius_2 = Circle.ByCenterPointRadius(byCoordinates_2, chop_2, lacing=Longest)
code_block_8 = CodeBlock { 0..#9..1; }
byCoordinates_3 = Point.ByCoordinates(code_block_8, code_block_8, lacing=CrossProduct)
code_block_9 = CodeBlock { 0..2; }
code_block_10 = CodeBlock { 0..2; }
数列分组 = Custom[数列分组](list=byCoordinates_3, index1=code_block_9, index2=code_block_10)
code_block_11 = CodeBlock { 0.1; }
code_block_12 = CodeBlock { 0.5; }
number_slider_3 = DoubleSlider(100, range=100..200 step 0.01)
number_slider_4 = DoubleSlider(40.12, range=0..100 step 0.01)
lunchbox_random_numbers_2 = Custom[LunchBox Random Numbers](Min=code_block_11, Max=code_block_12, Amount=number_slider_3, Seed=number_slider_4)
code_block_13 = CodeBlock { 10; }
chop_3 = List.Chop(lunchbox_random_numbers_2, code_block_13)
byCenterPointRadius_3 = Circle.ByCenterPointRadius(数列分组, chop_3)
code_block_14 = CodeBlock { 3..5; }
数列分组_2 = Custom[数列分组](list=byCoordinates_3, index1=code_block_9, index2=code_block_14)
byCenterPointRadius_4 = Circle.ByCenterPointRadius(数列分组_2, chop_3)
code_block_15 = CodeBlock { 6..8; }
数列分组_3 = Custom[数列分组](list=byCoordinates_3, index1=code_block_9, index2=code_block_15)
byCenterPointRadius_5 = Circle.ByCenterPointRadius(数列分组_3, chop_3)
code_block_16 = CodeBlock { 3..5; }
code_block_17 = CodeBlock { 0..2; }
数列分组_4 = Custom[数列分组](list=byCoordinates_3, index1=code_block_16, index2=code_block_17)
code_block_18 = CodeBlock { 0.1; }
code_block_19 = CodeBlock { 0.5; }
number_slider_5 = DoubleSlider(100, range=100..200 step 0.01)
number_slider_6 = DoubleSlider(40.12, range=0..100 step 0.01)
lunchbox_random_numbers_3 = Custom[LunchBox Random Numbers](Min=code_block_18, Max=code_block_19, Amount=number_slider_5, Seed=number_slider_6)
code_block_20 = CodeBlock { 10; }
chop_4 = List.Chop(lunchbox_random_numbers_3, code_block_20)
byCenterPointRadius_6 = Circle.ByCenterPointRadius(数列分组_4, chop_4)
code_block_21 = CodeBlock { 3..5; }
数列分组_5 = Custom[数列分组](list=byCoordinates_3, index1=code_block_16, index2=code_block_21)
byCenterPointRadius_7 = Circle.ByCenterPointRadius(数列分组_5, chop_4)
code_block_22 = CodeBlock { 6..8; }
数列分组_6 = Custom[数列分组](list=byCoordinates_3, index1=code_block_16, index2=code_block_22)
byCenterPointRadius_8 = Circle.ByCenterPointRadius(数列分组_6, chop_4)
code_block_23 = CodeBlock { 6..8; }
code_block_24 = CodeBlock { 0..2; }
数列分组_7 = Custom[数列分组](list=byCoordinates_3, index1=code_block_23, index2=code_block_24)
code_block_25 = CodeBlock { 0.1; }
code_block_26 = CodeBlock { 0.5; }
number_slider_7 = DoubleSlider(100, range=100..200 step 0.01)
number_slider_8 = DoubleSlider(40.12, range=0..100 step 0.01)
lunchbox_random_numbers_4 = Custom[LunchBox Random Numbers](Min=code_block_25, Max=code_block_26, Amount=number_slider_7, Seed=number_slider_8)
code_block_27 = CodeBlock { 10; }
chop_5 = List.Chop(lunchbox_random_numbers_4, code_block_27)
byCenterPointRadius_9 = Circle.ByCenterPointRadius(数列分组_7, chop_5)
code_block_28 = CodeBlock { 3..5; }
数列分组_8 = Custom[数列分组](list=byCoordinates_3, index1=code_block_23, index2=code_block_28)
byCenterPointRadius_10 = Circle.ByCenterPointRadius(数列分组_8, chop_5)
code_block_29 = CodeBlock { 6..8; }
数列分组_9 = Custom[数列分组](list=byCoordinates_3, index1=code_block_23, index2=code_block_29)
byCenterPointRadius_11 = Circle.ByCenterPointRadius(数列分组_9, chop_5)
create = List.Create(byCenterPointRadius_3, byCenterPointRadius_4, byCenterPointRadius_5, byCenterPointRadius_6, byCenterPointRadius_7, byCenterPointRadius_8, byCenterPointRadius_9, byCenterPointRadius_10, byCenterPointRadius_11)
code_block_30 = CodeBlock { 0..#9..1; }
byCoordinates_4 = Point.ByCoordinates(code_block_30, code_block_30, lacing=CrossProduct)
code_block_31 = CodeBlock { 0..2; }
code_block_32 = CodeBlock { 0..2; }
数列分组_10 = Custom[数列分组](list=byCoordinates_4, index1=code_block_31, index2=code_block_32)
code_block_33 = CodeBlock { 0.1; }
code_block_34 = CodeBlock { 0.5; }
number_slider_9 = DoubleSlider(100, range=4..200 step 0.01)
number_slider_10 = DoubleSlider(45, range=0..100 step 1)
lunchbox_random_numbers_5 = Custom[LunchBox Random Numbers](Min=code_block_33, Max=code_block_34, Amount=number_slider_9, Seed=number_slider_10)
code_block_35 = CodeBlock { 0; }
getItemAtIndex = List.GetItemAtIndex(lunchbox_random_numbers_5, code_block_35)
byCenterPointRadius_12 = Circle.ByCenterPointRadius(数列分组_10, getItemAtIndex)
code_block_36 = CodeBlock { 3..5; }
数列分组_11 = Custom[数列分组](list=byCoordinates_4, index1=code_block_31, index2=code_block_36)
code_block_37 = CodeBlock { 1; }
getItemAtIndex_2 = List.GetItemAtIndex(lunchbox_random_numbers_5, code_block_37)
byCenterPointRadius_13 = Circle.ByCenterPointRadius(数列分组_11, getItemAtIndex_2)
code_block_38 = CodeBlock { 6..8; }
数列分组_12 = Custom[数列分组](list=byCoordinates_4, index1=code_block_31, index2=code_block_38)
code_block_39 = CodeBlock { 2; }
getItemAtIndex_3 = List.GetItemAtIndex(lunchbox_random_numbers_5, code_block_39)
byCenterPointRadius_14 = Circle.ByCenterPointRadius(数列分组_12, getItemAtIndex_3)
code_block_40 = CodeBlock { 3..5; }
code_block_41 = CodeBlock { 0..2; }
数列分组_13 = Custom[数列分组](list=byCoordinates_4, index1=code_block_40, index2=code_block_41)
flatten_2 = Flatten(数列分组_13)
code_block_42 = CodeBlock { 3; }
getItemAtIndex_4 = List.GetItemAtIndex(lunchbox_random_numbers_5, code_block_42)
byCenterPointRadius_15 = Circle.ByCenterPointRadius(flatten_2, getItemAtIndex_4)
code_block_43 = CodeBlock { 3..5; }
数列分组_14 = Custom[数列分组](list=byCoordinates_4, index1=code_block_40, index2=code_block_43)
flatten_3 = Flatten(数列分组_14)
code_block_44 = CodeBlock { 4; }
getItemAtIndex_5 = List.GetItemAtIndex(lunchbox_random_numbers_5, code_block_44)
byCenterPointRadius_16 = Circle.ByCenterPointRadius(flatten_3, getItemAtIndex_5)
code_block_45 = CodeBlock { 6..8; }
数列分组_15 = Custom[数列分组](list=byCoordinates_4, index1=code_block_40, index2=code_block_45)
flatten_4 = Flatten(数列分组_15)
code_block_46 = CodeBlock { 5; }
getItemAtIndex_6 = List.GetItemAtIndex(lunchbox_random_numbers_5, code_block_46)
byCenterPointRadius_17 = Circle.ByCenterPointRadius(flatten_4, getItemAtIndex_6)
code_block_47 = CodeBlock { 6..8; }
code_block_48 = CodeBlock { 0..2; }
数列分组_16 = Custom[数列分组](list=byCoordinates_4, index1=code_block_47, index2=code_block_48)
flatten_5 = Flatten(数列分组_16)
code_block_49 = CodeBlock { 6; }
getItemAtIndex_7 = List.GetItemAtIndex(lunchbox_random_numbers_5, code_block_49)
byCenterPointRadius_18 = Circle.ByCenterPointRadius(flatten_5, getItemAtIndex_7)
code_block_50 = CodeBlock { 3..5; }
数列分组_17 = Custom[数列分组](list=byCoordinates_4, index1=code_block_47, index2=code_block_50)
flatten_6 = Flatten(数列分组_17)
code_block_51 = CodeBlock { 7; }
getItemAtIndex_8 = List.GetItemAtIndex(lunchbox_random_numbers_5, code_block_51)
byCenterPointRadius_19 = Circle.ByCenterPointRadius(flatten_6, getItemAtIndex_8)
code_block_52 = CodeBlock { 6..8; }
数列分组_18 = Custom[数列分组](list=byCoordinates_4, index1=code_block_47, index2=code_block_52)
flatten_7 = Flatten(数列分组_18)
code_block_53 = CodeBlock { 8; }
getItemAtIndex_9 = List.GetItemAtIndex(lunchbox_random_numbers_5, code_block_53)
byCenterPointRadius_20 = Circle.ByCenterPointRadius(flatten_7, getItemAtIndex_9)
create_2 = List.Create(byCenterPointRadius_12, byCenterPointRadius_13, byCenterPointRadius_14, byCenterPointRadius_15, byCenterPointRadius_16, byCenterPointRadius_17, byCenterPointRadius_18, byCenterPointRadius_19, byCenterPointRadius_20)
ZAxis = Vector.ZAxis()
extrudeAsSolid = Curve.ExtrudeAsSolid(arg1=ZAxis)
