# Dynamo graph 批量修改参数.dyn (Dynamo 0.9.1.4062)

获取视图 = Custom[获取视图]()  # Gets all views in the document - except for 3D view templates (as long as this bug is not fixed: https://github.com/DynamoDS/Dynamo/issues/2970)
code_block = CodeBlock { "视图分类-父"; }
getParameterValueByName = Element.GetParameterValueByName(element=获取视图.楼层平面, parameterName=code_block)
code_block_2 = CodeBlock { "风管"; }
contains = String.Contains(str=getParameterValueByName, searchFor=code_block_2)
filterByBoolMask = List.FilterByBoolMask(list=获取视图.楼层平面, mask=contains)
name = Level.Name(filterByBoolMask.in)
code_block_3 = CodeBlock { ""; }
replace = String.Replace(str=name, searchFor=code_block_2, replaceWith=code_block_3)
setParameterByName = Element.SetParameterByName()
all_elements_of_type = ElementsOfType()
code_block_4 = CodeBlock(x=all_elements_of_type) { x[1]; }
parameters = Element.Parameters(code_block_4)
code_block_5 = CodeBlock {  }
code_block_6 = CodeBlock { "视图分类-父"; }
getParameterValueByName_2 = Element.GetParameterValueByName(element=code_block_4, parameterName=code_block_6)
all_elements_of_family_type = ElementsOfFamilyType()
family_types = FamilyTypes("280℃矩形电动防火阀:标准")
all_elements_of_family_type_2 = ElementsOfFamilyType()
byLevel = FloorPlanView.ByLevel()
byLevel_2 = CeilingPlanView.ByLevel()
plane = Custom[View.Plane]()  # Retrieves the plane of a given view
获取视图_2 = Custom[获取视图]()
