# Dynamo graph 批量修改类型名称.dyn (Dynamo 0.9.1.4062)

code_block = CodeBlock { "ykdyfk远控多叶风口"; }
byName = Family.ByName(code_block)
name = Family.Name(byName)
element_types = ElementTypes("Family")
all_elements_of_type = ElementsOfType(element_types)
contains = String.Contains()
filterByBoolMask = List.FilterByBoolMask(list=all_elements_of_type, mask=contains)
types = Family.Types(byName)
code_block_2 = CodeBlock { "Name"; }
getParameterValueByName = Element.GetParameterValueByName(element=types, parameterName=code_block_2)
python_script = Python()
# ---------- python_script.python (30 lines) ----------
import clr

clr.AddReference("RevitAPI")
import Autodesk
from Autodesk.Revit.DB import *

clr.AddReference("RevitServices")
import RevitServices
from RevitServices.Persistence import DocumentManager
from RevitServices.Transactions import TransactionManager


clr.AddReference("RevitNodes")
import Revit


e = UnwrapElement(IN[0])
n=IN[1]


doc = DocumentManager.Instance.CurrentDBDocument
TransactionManager.Instance.EnsureInTransaction(doc)

for i in range(len(e)):
	e[i].Name=n[i]


TransactionManager.Instance.TransactionTaskDone()
#将输出内容指定给 OUT 变量。
OUT = 0
# ----------------------------------------
code_block_3 = CodeBlock { List.Flatten; }
name_2 = FamilyType.Name(types)
code_block_4 = CodeBlock { "x"; }
code_block_5 = CodeBlock { "*"; }
replace = String.Replace(str=name_2, searchFor=code_block_4, replaceWith=code_block_5)
flatten = Flatten(replace)
concat = String.Concat()
code_block_6 = CodeBlock { "*"; }
split = String.Split(name_2, code_block_6)
reverse = List.Reverse(split, lacing=Longest)
transpose = List.Transpose(reverse)
code_block_7 = CodeBlock(x=transpose) { x[0]; x[1]; }
python_script_2 = Python(IN[0]=split)
# ---------- python_script_2.python (13 lines) ----------
import clr
clr.AddReference('DSCoreNodes')
from  DSCore import *

li = IN
OUT = []
for i in range(len(li)):
	li[i].reverse()
	List.Flatten(li[i],0)
	a=String.Join("*",li[i][0][0],li[i][0][1])
	
#将输出内容指定给 OUT 变量。
OUT=IN
# ----------------------------------------
python_script_3 = Python()  # starter script, not edited (OUT = 0)
join = String.Join(code_block_6, reverse)
flatten_2 = Flatten(join)
python_script_4 = Python()  # starter script, not edited (OUT = 0)
