# Dynamo graph 批量修改视图参数.dyn (Dynamo 0.9.1.4062)

获取视图 = Custom[获取视图]()  # Gets all views in the document - except for 3D view templates (as long as this bug is not fixed: https://github.com/DynamoDS/Dynamo/issues/2970)
code_block = CodeBlock { "视图分类-父"; }
getParameterValueByName = Element.GetParameterValueByName(element=获取视图.楼层平面, parameterName=code_block)
code_block_2 = CodeBlock { "风管"; }
contains = String.Contains(str=getParameterValueByName, searchFor=code_block_2)
filterByBoolMask = List.FilterByBoolMask(list=获取视图.楼层平面, mask=contains)
code_block_3 = CodeBlock { "视图名称"; }
getParameterValueByName_2 = Element.GetParameterValueByName(element=filterByBoolMask.in, parameterName=code_block_3)
code_block_4 = CodeBlock { " "; }
split = String.Split(getParameterValueByName_2, code_block_4)
transpose = List.Transpose(split)
code_block_5 = CodeBlock(x=transpose) { x[0]; }
code_block_6 = CodeBlock { "风管"; }
python_script = Python(IN[0]=code_block_5, IN[1]=code_block_6)
# ---------- python_script.python (12 lines) ----------
import clr
clr.AddReference('ProtoGeometry')
from Autodesk.DesignScript.Geometry import *
#该节点的输入内容将存储为 IN 变量中的一个列表。
a = IN[0]
b = IN[1]
out=list()

for i in a:
	out.append(i+b)
#将输出内容指定给 OUT 变量。
OUT = out
# ----------------------------------------
setParameterByName = Element.SetParameterByName(element=filterByBoolMask.in, parameterName=code_block_3, value=python_script)
parameters = Element.Parameters(filterByBoolMask.in)
