# Dynamo graph 批量加墙面层（未完成）.dyn (Dynamo 0.8.1.830)

wall_types = WallTypes("常规 - 200mm")
lunchbox_wall_element_collector = Custom[LunchBox Wall Element Collector]()  # Collects wall elements from the Revit document.
map = List.Map(list=wall_types, f_x=lunchbox_wall_element_collector.Location_Curve)
byJoinedCurves = PolyCurve.ByJoinedCurves(map)
code_block = CodeBlock { -100; }
boolean = BoolSelector(false)
offset = PolyCurve.Offset(byJoinedCurves, code_block, boolean)
