# Dynamo graph 拾取坐标创建柱.dyn (Dynamo 0.8.1.1265)

# group: 拾取XYZ坐标创建柱
string = StringInput("Points")
readFromFile = CSV.ReadFromFile()
file_path = Filename("C:\Users\Administrator\Desktop\坐标点.txt")
fromPath = FileObject(file_path)  # "File.FromPath"
readFromFile_2 = CSV.ReadFromFile(fromPath)
transpose = List.Transpose(readFromFile_2)
code_block = CodeBlock { 0; 1; 2; }
getItemAtIndex = List.GetItemAtIndex(list=transpose, index=code_block.out0)
getItemAtIndex_2 = List.GetItemAtIndex(list=transpose, index=code_block.out1)
getItemAtIndex_3 = List.GetItemAtIndex(list=transpose, index=code_block.out2)
byCoordinates = Point.ByCoordinates(x=getItemAtIndex, y=getItemAtIndex_2, z=getItemAtIndex_3)
file_path_2 = Filename("C:\Users\Administrator\Desktop\坐标点.txt")
fromPath_2 = FileObject(file_path_2)  # "File.FromPath"
readFromFile_3 = CSV.ReadFromFile(fromPath_2)
transpose_2 = List.Transpose(readFromFile_3)
code_block_2 = CodeBlock { 0; 1; 2; }
getItemAtIndex_4 = List.GetItemAtIndex(list=transpose_2, index=code_block_2.out0)
getItemAtIndex_5 = List.GetItemAtIndex(list=transpose_2, index=code_block_2.out1)
getItemAtIndex_6 = List.GetItemAtIndex(list=transpose_2, index=code_block_2.out2)
number = DoubleInput(3000)
add = getItemAtIndex_6 + number
byCoordinates_2 = Point.ByCoordinates(x=getItemAtIndex_4, y=getItemAtIndex_5, z=add)
byStartPointEndPoint = Line.ByStartPointEndPoint(startPoint=byCoordinates, endPoint=byCoordinates_2)
levels = Levels("标高 1")
structural_column_types = StructuralColumnTypes("305x305x97UC")
columnByCurve = StructuralFraming.ColumnByCurve(byStartPointEndPoint, levels, structural_column_types)
watch = Watch(byCoordinates)
structural_column_types_2 = StructuralColumnTypes("305x305x97UC")
watch_2 = Watch(add)
readFromFile_4 = CSV.ReadFromFile()
string_2 = StringInput("Points")
