# Dynamo graph 提取点到墙的垂足.dyn (Dynamo 0.8.1.830)

number = DoubleInput(1111)
number_2 = DoubleInput(4444)
number_3 = DoubleInput(2222)
byCoordinates = Point.ByCoordinates(x=number, y=number_2, z=number_3)
select_model_elements = DSModelElementsSelection()  # 1 picked in the model
geometry = Element.Geometry(select_model_elements)
vertices = Face.Vertices(geometry)
pointGeometry = Vertex.PointGeometry(vertices)
flatten = Flatten(pointGeometry)
byBestFitThroughPoints = Line.ByBestFitThroughPoints(flatten)
startPoint = Curve.StartPoint(byBestFitThroughPoints)
X = Point.X(startPoint)
Y = Point.Y(startPoint)
Z = Point.Z(pointGeometry)
minimumItem = List.MinimumItem(Z)
byCoordinates_2 = Point.ByCoordinates(x=X, y=Y, z=minimumItem)
byTwoPoints = Vector.ByTwoPoints(start=byCoordinates, end=byCoordinates_2)
endPoint = Curve.EndPoint(byBestFitThroughPoints)
X_2 = Point.X(endPoint)
Y_2 = Point.Y(endPoint)
byCoordinates_3 = Point.ByCoordinates(x=X_2, y=Y_2, z=minimumItem)
byTwoPoints_2 = Vector.ByTwoPoints(start=byCoordinates, end=byCoordinates_3)
cross = Vector.Cross(vector=byTwoPoints, cross=byTwoPoints_2)
byStartPointEndPoint = Line.ByStartPointEndPoint(startPoint=byCoordinates_2, endPoint=byCoordinates_3)
direction = Line.Direction(byStartPointEndPoint)
cross_2 = Vector.Cross(vector=cross, cross=direction)
reverse = Vector.Reverse(cross_2)
X_3 = Vector.X(reverse)
Y_3 = Vector.Y(reverse)
Z_2 = Vector.Z(reverse)
boolean = BoolSelector(true)
byCoordinates_4 = Vector.ByCoordinates(x=X_3, y=Y_3, z=Z_2, normalized=boolean)
distanceTo = Geometry.DistanceTo(geometry=byCoordinates, other=byStartPointEndPoint)
scale = Vector.Scale(vector=byCoordinates_4, scale_factor=distanceTo)
add = Point.Add(point=byCoordinates, vectorToAdd=scale)
byStartPointEndPoint_2 = Line.ByStartPointEndPoint(startPoint=byCoordinates, endPoint=add)
watch_3d = Watch3D(byStartPointEndPoint_2)
family_types = FamilyTypes("固定:0610 x 0610 mm")
code_block = CodeBlock { 1; }
X_4 = Point.X(add)
Y_4 = Point.Y(add)
python_script = Python(IN[0]=select_model_elements, IN[1]=family_types, IN[2]=code_block, IN[3]=X_4, IN[4]=Y_4)
# ---------- python_script.python (57 lines) ----------
import clr
clr.AddReference('ProtoGeometry')
from Autodesk.DesignScript.Geometry import *

# Import RevitAPI
clr.AddReference('RevitAPI')
import Autodesk

# Import DocumentManager and TransactionManager
clr.AddReference('RevitServices')
import RevitServices
from RevitServices.Persistence import DocumentManager
from RevitServices.Transactions import TransactionManager

# Import ToDSType(bool) extension method
clr.AddReference('RevitNodes')
import Revit
clr.ImportExtensions(Revit.Elements)

walls = UnwrapElement(IN[0])
windowfamily = UnwrapElement(IN[1])
SillHeight = IN[2]/0.3048
Xzhou = IN[3]
Yzhou = IN[4]

wall = []


doc = DocumentManager.Instance.CurrentDBDocument
uiapp = DocumentManager.Instance.CurrentUIApplication
app = uiapp.Application
TransactionManager.Instance.EnsureInTransaction(doc)

for i in range (0,len(walls)):
	
	wall = walls[i]
	#search for existing windows and delete
	elList = wall.FindInserts(True, False, False, False)
	for elemId in elList:
		doc.Delete(elemId)
	# extract wall geometry and calculate middlepoint
	locCurve = wall.Location
	wallLength = locCurve.Curve.Length

	start = locCurve.Curve.GetEndPoint(0)
	end = locCurve.Curve.GetEndPoint(1)

	mittex = Xzhou
	mittey = Yzhou
	
	location = Autodesk.Revit.DB.XYZ(mittex,mittey,start.Z)

	famInst = doc.Create.NewFamilyInstance(location, windowfamily, wall, Autodesk.Revit.DB.Structure.StructuralType.NonStructural)
	famInst.get_Parameter('底高度').Set(SillHeight)

# End Transaction
TransactionManager.Instance.TransactionTaskDone()
# ----------------------------------------
byCoordinates_5 = Point.ByCoordinates(x=X_4, y=Y_4, z=number_3)
