# Dynamo graph 放样练习.dyn (Dynamo 0.8.1.1823)

code_block = CodeBlock { a=-90..270..#20; x=15..27..#20; z=Math.Sin(a)*2+2; PT=Point.ByCoordinates(x,0,z); }
byPoints = NurbsCurve.ByPoints(code_block.PT)
YAxis = Vector.YAxis()
code_block_2 = CodeBlock { {0,12}; }
translate = Geometry.Translate(geometry=byPoints, direction=YAxis, distance=code_block_2)
code_block_3 = CodeBlock { 0.5; }
pointAtParameter = Curve.PointAtParameter(curve=byPoints, param=code_block_3)
X = Point.X(pointAtParameter)
code_block_4 = CodeBlock { 6; 12; 4; }
byCoordinates = Point.ByCoordinates(x=X, y=code_block_4.out0, z=code_block_4.out0)
byCoordinates_2 = Point.ByCoordinates(x=X, y=code_block_4.out1, z=code_block_4.out2)
byThreePoints = Arc.ByThreePoints(firstPoint=pointAtParameter, secondPoint=byCoordinates, thirdPoint=byCoordinates_2)
byLoft = Surface.ByLoft(translate, byThreePoints)
code_block_5 = CodeBlock { {30,33,36}; }
code_block_6 = CodeBlock { {0,2,0}; }
byCoordinates_3 = Point.ByCoordinates(x=code_block_5, z=code_block_6)
byPoints_2 = NurbsCurve.ByPoints(byCoordinates_3)
code_block_7 = CodeBlock { {30,33,36}; }
code_block_8 = CodeBlock { 12; {0,2,0}; }
byCoordinates_4 = Point.ByCoordinates(x=code_block_7, y=code_block_8.out0, z=code_block_8.out1)
byPoints_3 = NurbsCurve.ByPoints(byCoordinates_4)
create = List.Create(byPoints_2, byPoints_3)
code_block_9 = CodeBlock { 1; }
removeItemAtIndex = List.RemoveItemAtIndex(list=byCoordinates_3, indices=code_block_9)
removeItemAtIndex_2 = List.RemoveItemAtIndex(list=byCoordinates_4, indices=code_block_9)
byStartPointEndPoint = Line.ByStartPointEndPoint(startPoint=removeItemAtIndex, endPoint=removeItemAtIndex_2)
firstItem = List.FirstItem(byStartPointEndPoint)
code_block_10 = CodeBlock { 1; }
getItemAtIndex = List.GetItemAtIndex(list=byCoordinates_3, index=code_block_10)
X_2 = Point.X(getItemAtIndex)
Z = Point.Z(getItemAtIndex)
code_block_11 = CodeBlock(n=Z) { a=0..720..#40; z=Math.Sin(a)+n; y=0..12..#40; }
byCoordinates_5 = Point.ByCoordinates(x=X_2, y=code_block_11.y, z=code_block_11.z)
byPoints_4 = NurbsCurve.ByPoints(byCoordinates_5)
lastItem = List.LastItem(byStartPointEndPoint)
create_2 = List.Create(firstItem, byPoints_4, lastItem)
byLoft_2 = Surface.ByLoft(create, create_2)
code_block_12 = CodeBlock {  }
code_block_13 = CodeBlock { a=-90..270..#20; x=0..12..#20; z=Math.Sin(a)*2+2; PT=Point.ByCoordinates(x,0,z); }
byPoints_5 = NurbsCurve.ByPoints(code_block_13.PT)
code_block_14 = CodeBlock()
# ---------- code_block_14.designscript (7 lines) ----------
a=90..450..#20;
a1=135..495..#20;
x=0..12..#20;
z1=Math.Sin(a)*2+2;
z2=Math.Sin(a)*2+2;
PT1=Point.ByCoordinates(x,6,z1);
PT2=Point.ByCoordinates(x,12,z2);
# ----------------------------------------
byPoints_6 = NurbsCurve.ByPoints(code_block_14.PT1)
byPoints_7 = NurbsCurve.ByPoints(code_block_14.PT2)
create_3 = List.Create(byPoints_5, byPoints_6, byPoints_7)
byLoft_3 = Surface.ByLoft(create_3)
code_block_15 = CodeBlock { 12; 12; }
code_block_16 = CodeBlock(u=code_block_15.out0, v=code_block_15.out1) { 0..1..#u+1; 0..1..#v+1; }
pointAtParameter_2 = Surface.PointAtParameter(surface=byLoft_3, u=code_block_16.out0, v=code_block_16.out1, lacing=CrossProduct)
flatten = Flatten(pointAtParameter_2)
code_block_17 = CodeBlock { 13; }
diagonalLeft = List.DiagonalLeft(flatten, code_block_17)
count = List.Count(diagonalLeft)
code_block_18 = CodeBlock(n=count) { 1..n-2; }
getItemAtIndex_2 = List.GetItemAtIndex(list=diagonalLeft, index=code_block_18)
byPoints_8 = NurbsCurve.ByPoints(getItemAtIndex_2)
code_block_19 = CodeBlock { 13; }
diagonalRight = List.DiagonalRight(flatten, code_block_19)
count_2 = List.Count(diagonalRight)
code_block_20 = CodeBlock(n=count_2) { 1..n-2; }
getItemAtIndex_3 = List.GetItemAtIndex(list=diagonalRight, index=code_block_20)
byPoints_9 = NurbsCurve.ByPoints(getItemAtIndex_3)
