# Dynamo graph 模型线改房间编号.dyn (Dynamo 0.8.0.706)

select_model_element = DSModelElementSelection()  # 1 picked in the model
curve = CurveElement.Curve(select_model_element)
code_block = CodeBlock { 100; }
divideEqually = Curve.DivideEqually(curve, code_block)
endPoint = Curve.EndPoint(divideEqually)
categories = Categories("Rooms")
all_elements_of_category = ElementsOfCategory(categories)
boundingBox = Geometry.BoundingBox(all_elements_of_category)
contains = BoundingBox.Contains(boundingBox)
map = List.Map(list=endPoint, f_x=contains)
filterByBoolMask = List.FilterByBoolMask(list=all_elements_of_category)
map_2 = List.Map(list=map, f_x=filterByBoolMask.in)
flatten = Flatten(map_2)
uniqueItems = List.UniqueItems(flatten)
code_block_2 = CodeBlock { "编号"; }
code_block_3 = CodeBlock { 2000; }
count = Count(uniqueItems)
code_block_4 = CodeBlock { 1; }
number_sequence = NumberSeq(code_block_3, count, code_block_4, lacing=Longest)
string_from_object = FromObject(number_sequence)
setParameterByName = Element.SetParameterByName(element=uniqueItems, parameterName=code_block_2, value=string_from_object)
