# Dynamo graph 沿路径随机布树.dyn (Dynamo 0.8.1.1265)

family_types = FamilyTypes("RPC 树 - 落叶树:日本樱桃树 - 4.5 米")
family_types_2 = FamilyTypes("RPC 树 - 落叶树:Shumard 橡树 - 9.1 米")
family_types_3 = FamilyTypes("RPC 树 - 落叶树:大齿白杨 - 7.6 米")
create = List.Create(family_types, family_types_2, family_types_3)
integer_slider = IntegerSlider(8, range=1..20 step 1)
cycle = List.Cycle(list=create, amount=integer_slider)
shuffle = List.Shuffle(cycle)
code_block = CodeBlock { 3; }
takeEveryNthItem = List.TakeEveryNthItem(shuffle, code_block)
select_model_elements = DSModelElementsSelection()  # 1 picked in the model
curves = Element.Curves(select_model_elements)
code_block_2 = CodeBlock(num=integer_slider) { 0..1..#num; }
pointAtParameter = Curve.PointAtParameter(curve=curves, param=code_block_2, lacing=Longest)
tangentAtParameter = Curve.TangentAtParameter(curves, code_block_2, lacing=Longest)
ZAxis = Vector.ZAxis()
cross = Vector.Cross(vector=tangentAtParameter, cross=ZAxis)
normalized = Vector.Normalized(cross)
number_slider = DoubleSlider(4000, range=1000..5000 step 100)
code_block_3 = CodeBlock(a=number_slider) { 0; 1; a; -a; }
randomList = Math.RandomList(integer_slider)
mapTo = MapTo(code_block_3.out0, code_block_3.out1, randomList, code_block_3.out3, code_block_3.a)
shuffle_2 = List.Shuffle(mapTo)
scale = Vector.Scale(vector=normalized, scale_factor=shuffle_2)
add = Point.Add(point=pointAtParameter, vectorToAdd=scale)
byPoint = FamilyInstance.ByPoint(takeEveryNthItem, add)
