# Dynamo graph 环形螺旋.dyn (Dynamo 0.9.0.3067)

XY = Plane.XY()
code_block = CodeBlock { 10; }
byPlaneRadius = Circle.ByPlaneRadius(plane=XY, radius=code_block)
amount_of_coils = IntegerSlider(50, range=10..50 step 1)
code_block_2 = CodeBlock(numberOfCoils=amount_of_coils) { 0..1..#numberOfCoils; }
planeAtParameter = Curve.PlaneAtParameter(curve=byPlaneRadius, param=code_block_2)
reverse_midway = BoolSelector(false)
max_size_of_coils = IntegerSlider(2, range=2..10 step 1)
code_block_3 = CodeBlock(size=max_size_of_coils, x=planeAtParameter)
# ---------- code_block_3.designscript (4 lines) ----------
total = 1..size..#Count(x);
halfList = List.TakeItems(total,Count(total)/2);
reversedList = List.Reverse(halfList);
Flatten({halfList,reversedList});
# ----------------------------------------
code_block_4 = CodeBlock(size=max_size_of_coils, x=planeAtParameter) { size..size..#Count(x); }
if_ = If(test=reverse_midway, true=code_block_3.out3, false=code_block_4)
byPlaneRadius_2 = Circle.ByPlaneRadius(plane=planeAtParameter, radius=if_)
code_block_5 = CodeBlock { 0..1..#7; }
pointAtParameter = Curve.PointAtParameter(curve=byPlaneRadius_2, param=code_block_5, lacing=CrossProduct)
code_block_6 = CodeBlock(x=pointAtParameter) { cycled = List.Cycle(0..4..1,Count(x)); List.TakeItems(cycled,Count(x)); }
getItemAtIndex = List.GetItemAtIndex(list=pointAtParameter, index=code_block_6.out1, lacing=Longest)
byPoints = NurbsCurve.ByPoints(getItemAtIndex)
code_block_7 = CodeBlock { 0; }
planeAtParameter_2 = Curve.PlaneAtParameter(curve=byPoints, param=code_block_7)
code_block_8 = CodeBlock { 0.125; }
byPlaneRadius_3 = Circle.ByPlaneRadius(plane=planeAtParameter_2, radius=code_block_8)
sweepAsSolid = Curve.SweepAsSolid(byPlaneRadius_3, byPoints)
