# Dynamo graph 篮子.dyn (Dynamo 0.8.1.1823)

code_block = CodeBlock { 0..2..#20; }
byCoordinates = Point.ByCoordinates(z=code_block)
code_block_2 = CodeBlock { 0..120..#20; }
code_block_3 = CodeBlock(a=code_block_2) { Math.Sin(a); }
code_block_4 = CodeBlock(a=code_block_3) { a+1.5; }
byCenterPointRadius = Circle.ByCenterPointRadius(centerPoint=byCoordinates, radius=code_block_4)
code_block_5 = CodeBlock { 2; 2; }
takeEveryNthItem = List.TakeEveryNthItem(byCenterPointRadius, code_block_5.out0, code_block_5.out1)
code_block_6 = CodeBlock { 0..1..#40; }
coordinateSystemAtParameter = Curve.CoordinateSystemAtParameter(takeEveryNthItem, code_block_6, lacing=CrossProduct)
code_block_7 = CodeBlock { {-0.05,0.05}; 20; 10; }
cycle = List.Cycle(list=code_block_7.out0, amount=code_block_7.out1)
create = List.Create(cycle)
cycle_2 = List.Cycle(list=create, amount=code_block_7.out2)
byCartesianCoordinates = Point.ByCartesianCoordinates(coordinateSystemAtParameter, cycle_2)
byPoints = NurbsCurve.ByPoints(byCartesianCoordinates)
code_block_8 = CodeBlock { 0..1..#40; }
planeAtParameter = Curve.PlaneAtParameter(curve=byPoints, param=code_block_8, lacing=CrossProduct)
code_block_9 = CodeBlock { 0.04; 0.02; }
byPlaneRadii = Ellipse.ByPlaneRadii(planeAtParameter, code_block_9.out0, code_block_9.out1)
byLoft = Surface.ByLoft(byPlaneRadii)
code_block_10 = CodeBlock { 0.04; }
code_block_11 = CodeBlock { 2; 1; }
takeEveryNthItem_2 = List.TakeEveryNthItem(byCenterPointRadius, code_block_11.out0, code_block_11.out1)
code_block_12 = CodeBlock { 0..1..#40; }
coordinateSystemAtParameter_2 = Curve.CoordinateSystemAtParameter(takeEveryNthItem_2, code_block_12, lacing=CrossProduct)
code_block_13 = CodeBlock { {0.05,-0.05}; 20; 10; }
cycle_3 = List.Cycle(list=code_block_13.out0, amount=code_block_13.out1)
create_2 = List.Create(cycle_3)
cycle_4 = List.Cycle(list=create_2, amount=code_block_13.out2)
byCartesianCoordinates_2 = Point.ByCartesianCoordinates(coordinateSystemAtParameter_2, cycle_4)
byPoints_2 = NurbsCurve.ByPoints(byCartesianCoordinates_2)
code_block_14 = CodeBlock { 0..1..#40; }
planeAtParameter_2 = Curve.PlaneAtParameter(curve=byPoints_2, param=code_block_14, lacing=CrossProduct)
code_block_15 = CodeBlock { 0.04; 0.02; }
byPlaneRadii_2 = Ellipse.ByPlaneRadii(planeAtParameter_2, code_block_15.out0, code_block_15.out1)
byLoft_2 = Surface.ByLoft(byPlaneRadii_2)
code_block_16 = CodeBlock { 0..1..#40; }
pointAtParameter = Curve.PointAtParameter(curve=byCenterPointRadius, param=code_block_16, lacing=CrossProduct)
transpose = List.Transpose(pointAtParameter)
byPoints_3 = NurbsCurve.ByPoints(transpose)
code_block_17 = CodeBlock { 0..1..#10; }
planeAtParameter_3 = Curve.PlaneAtParameter(curve=byPoints_3, param=code_block_17, lacing=CrossProduct)
code_block_18 = CodeBlock { 0.1; 0.03; }
byPlaneRadii_3 = Ellipse.ByPlaneRadii(planeAtParameter_3, code_block_18.out0, code_block_18.out1)
byLoft_3 = Solid.ByLoft(byPlaneRadii_3)
log = Math.Log()
maximumItem = List.MaximumItem()
