# Dynamo custom node 获取视图.dyf (Dynamo 0.9.1.4062)
# category: Clockwork.Revit.Document.Query
# Gets all views in the document - except for 3D view templates (as long as this bug is not fixed: https://github.com/DynamoDS/Dynamo/issues/2970)

python_script = Python()
# ---------- python_script.python (25 lines) ----------
import clr
clr.AddReference('RevitAPI')
from Autodesk.Revit.DB import *
import Autodesk

clr.AddReference("RevitServices")
import RevitServices
from RevitServices.Persistence import DocumentManager

doc = DocumentManager.Instance.CurrentDBDocument
collector = FilteredElementCollector(doc)
views = collector.OfClass(View).ToElements()
viewlist = list()
planlist = list()
for view in views:
	if view.ViewType == ViewType.ThreeD:
		if not(view.IsTemplate):
			viewlist.append(view)
	else:
		viewlist.append(view)
		
for v in viewlist:
	if v.get_Parameter(BuiltInParameter.VIEW_FAMILY_SCHEDULES).AsString() == "楼层平面":
		planlist.append(v)
OUT = [viewlist,planlist]
# ----------------------------------------
code_block = CodeBlock(x=python_script) { x[0]; x[1]; }
Views = Output(code_block.out0)
楼层平面 = Output(code_block.out1)
