# Dynamo graph 螺旋.dyn (Dynamo 0.8.0.950)

code_block = CodeBlock { 0.5; }
code_block_2 = CodeBlock { 5; }
code_block_3 = CodeBlock { 1; 200; 2; }
number_sequence = NumberSeq(code_block_3.out0, code_block_3.out1, code_block_3.out2, lacing=Longest)
mul = code_block_2 * number_sequence  # lacing=Longest
sin = Math.Sin(mul, lacing=Longest)
mul_2 = sin * number_sequence  # lacing=Longest
mul_3 = code_block * mul_2
cos = Math.Cos(mul, lacing=Longest)
mul_4 = cos * number_sequence  # lacing=Longest
mul_5 = mul_4 * code_block
byCoordinates = Point.ByCoordinates(x=mul_3, y=number_sequence, z=mul_5, lacing=Longest)
byPoints = PolyCurve.ByPoints(points=byCoordinates)
YAxis = Vector.YAxis()
code_block_4 = CodeBlock { 50; }
extrude = Curve.Extrude(curve=byPoints, direction=YAxis, distance=code_block_4)
code_block_5 = CodeBlock { 5; }
thicken = Surface.Thicken(surface=extrude, thickness=code_block_5)
byGeometry = ImportInstance.ByGeometry(thicken)
