# Dynamo graph 面层.dyn (Dynamo 0.7.5.3566)

select_model_element = DSModelElementSelection()  # 1 picked in the model
code_block = CodeBlock { "无连接高度"; }
getParameterValueByName = Element.GetParameterValueByName(select_model_element, code_block)
watch = Watch(getParameterValueByName)
code_block_2 = CodeBlock { "顶部偏移"; }
select_face = DSFaceSelection()  # 1 picked in the model
perimeterCurves = Surface.PerimeterCurves(select_face)
firstItem = List.FirstItem(perimeterCurves)
YAxis = Vector.YAxis()
code_block_3 = CodeBlock { 10.1; }
translate = Geometry.Translate(firstItem, YAxis, code_block_3)
code_block_4 = CodeBlock { 1..8; }
code_block_5 = CodeBlock { 1..360..#8; }
sin = Math.Sin(code_block_5)
code_block_6 = CodeBlock { 0; }
code_block_7 = CodeBlock(x=code_block_4, y=sin, z=code_block_6) { Point.ByCoordinates(x,y,z); }
byControlPoints = NurbsCurve.ByControlPoints(code_block_7)
code_block_8 = CodeBlock { 4; }
levels = Levels("1F")
wall_types = WallTypes("CW 102-50-100p")
byCurveAndHeight = Wall.ByCurveAndHeight(byControlPoints, code_block_8, levels, wall_types)
code_block_9 = CodeBlock { "底部限制条件"; }
getParameterValueByName_2 = Element.GetParameterValueByName(select_model_element, code_block_9)
watch_2 = Watch(getParameterValueByName_2)
byCurveAndHeight_2 = Wall.ByCurveAndHeight()
code_block_10 = CodeBlock { Point.ByCoordinates(1,1,1); }
code_block_11 = CodeBlock { Point.ByCoordinates(19,11,1); }
code_block_12 = CodeBlock(x=code_block_10, y=code_block_11) { Line.ByStartPointEndPoint(x,y); }
levels_2 = Levels("2F")
byCurveAndLevels = Wall.ByCurveAndLevels(code_block_12, levels, levels_2, wall_types)
